# Grasshopper definition BasicWaffleStructure - No Roof.gh (Grasshopper 1.0.7)

curve = Curve([<curve referenced from the Rhino model> x4])
curve_2 = Curve([<curve referenced from the Rhino model> x4])
curve_3 = Curve([<curve referenced from the Rhino model> x4])
curve_4 = Curve([<curve referenced from the Rhino model> x4])
curve_5 = Curve([<curve referenced from the Rhino model> x4])
curve_6 = Curve(<curve referenced from the Rhino model>)
join_curves = JoinCurves(Curves=curve_5, Preserve=False)
join_curves_2 = JoinCurves(Curves=curve, Preserve=False)
join_curves_3 = JoinCurves(Curves=curve_2, Preserve=False)
join_curves_4 = JoinCurves(Curves=curve_3, Preserve=False)
brep = Brep(curve_6)
join_curves_5 = JoinCurves(Curves=curve_4, Preserve=False)
negative = Negative(Value=Slider(2, range=0..10))
divide_domain² = DivideDomain²(Domain=brep, UCount=Slider(10, range=0..10), VCount=Slider(10, range=0..10))
negative_2 = Negative(Value=Slider(2, range=0..10))
offset_curve = OffsetCurve(Curve=join_curves, Distance=negative, Plane=PlaneXY(0, 0, 0), Corners=1)
offset_curve_2 = OffsetCurve(Curve=join_curves_2, Distance=Slider(2, range=0..10), Plane=PlaneXY(0, 0, 0), Corners=1)
offset_curve_3 = OffsetCurve(Curve=join_curves_3, Distance=Slider(2, range=0..10), Plane=PlaneXY(0, 0, 0), Corners=1)
offset_curve_4 = OffsetCurve(Curve=join_curves_4, Distance=Slider(2, range=0..10), Plane=PlaneXY(0, 0, 0), Corners=1)
offset_curve_5 = OffsetCurve(Curve=join_curves_5, Distance=negative_2, Plane=PlaneXY(0, 0, 0), Corners=1)
isotrim = Isotrim(Surface=brep, Domain=divide_domain²)
number_slider = Slider(16, range=0..20)
number_slider_2 = Slider(16, range=0..20)
number_slider_3 = Slider(16, range=0..20)
number_slider_4 = Slider(12, range=0..20)
number_slider_5 = Slider(16, range=0..20)
brep_2 = Brep(offset_curve)
brep_3 = Brep(offset_curve_2)
brep_4 = Brep(offset_curve_3)
brep_5 = Brep(offset_curve_4)
brep_6 = Brep(offset_curve_5)
offset_curve_6 = OffsetCurve(Curve=isotrim, Distance=Slider(-1, range=-5..5), Plane=PlaneXY(0, 0, 0), Corners=1)
divide_domain²_2 = DivideDomain²(Domain=brep_2, UCount=number_slider, VCount=number_slider)
divide_domain²_3 = DivideDomain²(Domain=brep_3, UCount=number_slider_2, VCount=number_slider_2)
divide_domain²_4 = DivideDomain²(Domain=brep_4, UCount=number_slider_3, VCount=number_slider_3)
divide_domain²_5 = DivideDomain²(Domain=brep_5, UCount=number_slider_4, VCount=number_slider_4)
divide_domain²_6 = DivideDomain²(Domain=brep_6, UCount=number_slider_5, VCount=number_slider_5)
fillet = Fillet(Curve=offset_curve_6, Radius=Slider(0.5, range=0..1))
isotrim_2 = Isotrim(Surface=brep_2, Domain=divide_domain²_2)
isotrim_3 = Isotrim(Surface=brep_3, Domain=divide_domain²_3)
isotrim_4 = Isotrim(Surface=brep_4, Domain=divide_domain²_4)
isotrim_5 = Isotrim(Surface=brep_5, Domain=divide_domain²_5)
isotrim_6 = Isotrim(Surface=brep_6, Domain=divide_domain²_6)
region_difference = RegionDifference(CurvesA=graft(isotrim), CurvesB=fillet)
offset_curve_loose = OffsetCurveLoose(Curve=isotrim_2, Distance=Slider(-0.5, range=-5..5))
offset_curve_loose_2 = OffsetCurveLoose(Curve=isotrim_3, Distance=Slider(-0.5, range=-5..5))
offset_curve_loose_3 = OffsetCurveLoose(Curve=isotrim_4, Distance=Slider(-0.5, range=-5..5))
offset_curve_loose_4 = OffsetCurveLoose(Curve=isotrim_5, Distance=Slider(-0.5, range=-5..5))
offset_curve_loose_5 = OffsetCurveLoose(Curve=isotrim_6, Distance=Slider(-0.5, range=-5..5))
boundary_surfaces = BoundarySurfaces(Edges=region_difference)
unit_z = UnitZ(Factor=Slider(3, range=0..10))
extrude = Extrude(Base=boundary_surfaces, Direction=unit_z)
area = Area(Geometry=offset_curve_loose)  # -> Area, Centroid
area_2 = Area(Geometry=offset_curve_loose_2)  # -> Area, Centroid
area_3 = Area(Geometry=offset_curve_loose_3)  # -> Area, Centroid
unit_z_2 = UnitZ(Factor=Slider(50, range=0..50))
unit_z_3 = UnitZ(Factor=Slider(50, range=0..50))
fillet_2 = Fillet(Curve=offset_curve_loose, Radius=Slider(0.5, range=0..1))
unit_z_4 = UnitZ(Factor=Slider(50, range=0..50))
fillet_3 = Fillet(Curve=offset_curve_loose_2, Radius=Slider(0.5, range=0..1))
area_4 = Area(Geometry=offset_curve_loose_4)  # -> Area, Centroid
fillet_4 = Fillet(Curve=offset_curve_loose_3, Radius=Slider(0.5, range=0..1))
area_5 = Area(Geometry=offset_curve_loose_5)  # -> Area, Centroid
unit_z_5 = UnitZ(Factor=Slider(50, range=0..50))
fillet_5 = Fillet(Curve=offset_curve_loose_4, Radius=Slider(0.5, range=0..1))
unit_z_6 = UnitZ(Factor=Slider(50, range=0..50))
fillet_6 = Fillet(Curve=offset_curve_loose_5, Radius=Slider(0.5, range=0..1))
panel = Panel(area.Area)
panel_2 = Panel(area_2.Area)
extrude_2 = Extrude(Base=fillet_2, Direction=unit_z_2)
panel_3 = Panel(area_3.Area)
extrude_3 = Extrude(Base=fillet_3, Direction=unit_z_3)
extrude_4 = Extrude(Base=fillet_4, Direction=unit_z_4)
panel_4 = Panel(area_4.Area)
extrude_5 = Extrude(Base=fillet_5, Direction=unit_z_5)
panel_5 = Panel(area_5.Area)
extrude_6 = Extrude(Base=fillet_6, Direction=unit_z_6)
geometry = Geometry()
