# Grasshopper definition BeamGeneration_At_Roof.gh (Grasshopper 1.0.7)
# plug-ins: Pufferfish

# ----
# Split Waffle Volumes
# Select Super Roof
brep = Brep(<brep referenced from the Rhino model>)

# ----
# BEAM STRUCTURE
# Projected Curves
# Beam Profile
curve = Curve(graft([<curve referenced from the Rhino model> x158]))
geometry = Geometry(<curve referenced from the Rhino model>)

# ----
# Waffle Structure
# Select a surface
#  - area inside - (As made by the beam layout)
brep_2 = Brep(<brep referenced from the Rhino model>)

explode = Explode(Curve=geometry, Recursive=True)  # -> Segments, Vertices
end_points = EndPoints(Curve=curve)  # -> Start, End
list_item = ListItem(List=explode.Segments, Index=0, Wrap=True)  # -> Item, Item1, Item2, Item3, Item4
list_item_2 = ListItem(List=explode.Vertices, Index=0, Wrap=True)  # -> Item, Item1, Item2, Item3, Item4
deconstruct = Deconstruct(Point=end_points.End)  # -> XComponent, YComponent, ZComponent
deconstruct_2 = Deconstruct(Point=end_points.Start)  # -> XComponent, YComponent, ZComponent
point = Point(list_item_2.Item3)
curve_middle = CurveMiddle(Curve=list_item.Item2)
line = Line(StartPoint=curve_middle, EndPoint=point)
subtraction = Subtraction(A=deconstruct.ZComponent, B=deconstruct_2.ZComponent)
length = Length(Curve=line)
move_to_point = MoveToPoint(Geometry=geometry, PointA=curve_middle, PointB=end_points.Start)  # -> Moved, Vector, Transform
panel = Panel(subtraction)
deconstruct_brep = DeconstructBrep(Brep=brep_2)  # -> Faces, Edges, Vertices
explode_2 = Explode(Curve=move_to_point.Moved, Recursive=True)  # -> Segments, Vertices
curve_2 = Curve([<curve referenced from the Rhino model> x3])
unit_z = UnitZ(Factor=panel)
panel_2 = Panel(length)
geometry_2 = Geometry(deconstruct_brep.Edges)
join_curves = JoinCurves(Curves=curve_2, Preserve=False)
list_item_3 = ListItem(List=explode_2.Vertices, Index=0, Wrap=True)  # -> Item, Item1, Item2, Item3
list_item_4 = ListItem(List=explode_2.Segments, Index=0, Wrap=True)  # -> Item, Item1, Item2, Item3
negative = Negative(Value=unit_z)
join_curves_2 = JoinCurves(Curves=geometry_2, Preserve=False)
move = Move(Geometry=end_points.End, Motion=negative)  # -> Geometry, Transform
curve_middle_2 = CurveMiddle(Curve=list_item_4.Item2)
offset_curve = OffsetCurve(Curve=join_curves_2, Distance=panel_2, Plane=PlaneXY(0, 0, 0), Corners=1)
line_2 = Line(StartPoint=list_item_3.Item3, EndPoint=curve_middle_2)

# ----
# Change the values to
# play with the size of the
# openings
number_slider = Slider(14, range=0..25)
number_slider_2 = Slider(11, range=0..20)

# ----
# Play with these
# sliders before
# changing the top values.
# (Look at the top view)
number_slider_3 = Slider(14, range=0..25)
# 14
# 15
# (Big Blocks)
number_slider_4 = Slider(11, range=0..20)

perp_frames = PerpFrames(Curve=line_2, Count="1", Align=True)  # -> Frames, Parameters
brep_3 = Brep(offset_curve)
line_3 = Line(StartPoint=end_points.Start, EndPoint=move.Geometry)
perp_frames_2 = PerpFrames(Curve=line_3, Count="1", Align=True)  # -> Frames, Parameters
list_item_5 = ListItem(List=perp_frames.Frames, Index=0, Wrap=True)  # -> Item, Item1
divide_domain² = DivideDomain²(Domain=brep_3, UCount=number_slider, VCount=number_slider_2)
equality = Equality(FirstNumber=number_slider, SecondNumber=number_slider_3)  # -> Equality, Inequality
equality_2 = Equality(FirstNumber=number_slider_2, SecondNumber=number_slider_4)  # -> Equality, Inequality
plane = Plane(list_item_5.Item1)
divide_domain²_2 = DivideDomain²(Domain=brep_3, UCount=number_slider_3, VCount=number_slider_4)
list_item_6 = ListItem(List=perp_frames_2.Frames, Index=0, Wrap=True)  # -> Item, Item1
isotrim = Isotrim(Surface=brep_3, Domain=divide_domain²)
plane_2 = Plane(list_item_6.Item)
number_slider_5 = Slider(-0.5, range=-5..5)
isotrim_2 = Isotrim(Surface=brep_3, Domain=divide_domain²_2)
orient = Orient(Geometry=move_to_point.Moved, Source=plane, Target=plane_2)  # -> Geometry, Transform
offset_curve_loose = OffsetCurveLoose(Curve=isotrim, Distance=number_slider_5)
number_slider_6 = Slider(0.5, range=0..1)
offset_curve_loose_2 = OffsetCurveLoose(Curve=isotrim_2, Distance=number_slider_5)
explode_3 = Explode(Curve=orient.Geometry, Recursive=True)  # -> Segments, Vertices
list_item_7 = ListItem(List=explode_3.Segments, Index=0, Wrap=True)
area = Area(Geometry=offset_curve_loose)  # -> Area, Centroid
fillet = Fillet(Curve=offset_curve_loose, Radius=number_slider_6)
fillet_2 = Fillet(Curve=offset_curve_loose_2, Radius=number_slider_6)
deconstruct_brep_2 = DeconstructBrep(Brep=brep)  # -> Faces, Edges, Vertices
brep_curve = BrepCurve(Brep=brep_3, Curve=fillet)  # -> Curves, Points
curve_middle_3 = CurveMiddle(Curve=list_item_7)
panel_3 = Panel(area.Area)
brep_curve_2 = BrepCurve(Brep=brep_3, Curve=fillet_2)  # -> Curves, Points
unit_z_2 = UnitZ(Factor=Slider(0.5, range=0..5))
list_item_8 = ListItem(List=deconstruct_brep_2.Faces, Index=0, Wrap=True)
brep_4 = Brep(flatten(brep_curve.Curves))
line_4 = Line(StartPoint=end_points.Start, EndPoint=curve_middle_3)
unit_z_3 = UnitZ(Factor=Slider(4, range=0..5))
brep_5 = Brep(flatten(brep_curve_2.Curves))

# ----
# Change the value to
# decrease the percentage
# of openings.
number_slider_7 = Slider(0.2, range=0..1)

# ----
# Play with slider for faster results on the variation of openings. (White is openings)
number_slider_8 = Slider(0.2, range=0..1)

negative_2 = Negative(Value=unit_z_2)
rotate_axis = RotateAxis(Geometry=orient.Geometry, Angle=degrees(Slider(90, range=0..360)), Axis=line_4)  # -> Geometry, Transform
move_2 = Move(Geometry=list_item_8, Motion=negative_2)  # -> Geometry, Transform
move_3 = Move(Geometry=list_item_8, Motion=unit_z_3)  # -> Geometry, Transform
jitter = Jitter(List=brep_4, Jitter=Slider(0.789, range=0..1), Seed=2)  # -> Values, Indices
sweep1 = Sweep1(Rail=curve, Sections=rotate_axis.Geometry, Miter=1)
list_length = ListLength(List=jitter.Values)
multiplication = Multiplication(A=list_length, B=number_slider_7)
split_list = SplitList(List=jitter.Values, Index=multiplication)  # -> ListA, ListB
brep_6 = Brep(split_list.ListA)
number_slider_9 = Slider(100, range=0..100)
brep_7 = Brep(split_list.ListB)
unit_z_4 = UnitZ(Factor=number_slider_9)
unit_z_5 = UnitZ(Factor=number_slider_9)
extrude = Extrude(Base=brep_7, Direction=unit_z_4)
extrude_2 = Extrude(Base=brep_6, Direction=unit_z_5)
split_brep = SplitBrep(Brep=extrude_2, Cutter=move_3.Geometry)
split_brep_2 = SplitBrep(Brep=extrude, Cutter=move_2.Geometry)
cull_index = CullIndex(List=split_brep, Indices="1", Wrap=True)
split_brep_multiple = SplitBrepMultiple(Brep=move_2.Geometry, Cutters=split_brep_2)
cull_index_2 = CullIndex(List=split_brep_2, Indices=Slider(1, range=0..1), Wrap=True)
split_brep_multiple_2 = SplitBrepMultiple(Brep=move_3.Geometry, Cutters=split_brep)
list_length_2 = ListLength(List=jitter.Values)
cull_index_3 = CullIndex(List=split_brep_multiple, Indices=Slider(0, range=0..1), Wrap=True)
multiplication_2 = Multiplication(A=list_length_2, B=number_slider_8)
cull_index_4 = CullIndex(List=split_brep_multiple_2, Indices=Slider(0, range=0..1), Wrap=True)
merge = Merge(Data1=cull_index_2, Data2=cull_index_3)
split_list_2 = SplitList(List=jitter.Values, Index=multiplication_2)  # -> ListA, ListB
merge_2 = Merge(Data1=cull_index, Data2=cull_index_4)
brep_join = BrepJoin(Breps=merge)  # -> Breps, Closed
brep_join_2 = BrepJoin(Breps=merge_2)  # -> Breps, Closed
unit_z_6 = UnitZ(Factor=number_slider_9)
unit_z_7 = UnitZ(Factor=number_slider_9)
brep_8 = Brep(split_list_2.ListA)
colour_swatch = ColourSwatch(SwatchColor=RGB(255, 255, 255))
brep_9 = Brep(split_list_2.ListB)
colour_swatch_2 = ColourSwatch(SwatchColor=RGB(0, 0, 0))
move_4 = Move(Geometry=brep_5, Motion=unit_z_6)  # -> Geometry, Transform
move_5 = Move(Geometry=brep_9, Motion=unit_z_7)  # -> Geometry, Transform
move_6 = Move(Geometry=brep_8, Motion=unit_z_6)  # -> Geometry, Transform
brep_10 = Brep(move_6.Geometry)
custom_preview = CustomPreview(Geometry=[brep_6, brep_10], Material=colour_swatch)
brep_11 = Brep(move_5.Geometry)
custom_preview_2 = CustomPreview(Geometry=[brep_7, brep_11], Material=colour_swatch_2)
brep_12 = Brep(move_4.Geometry)
cap_holes = CapHoles(Brep=sweep1)
custom_preview_3 = CustomPreview(Geometry=brep_12, Material=ColourSwatch(SwatchColor=RGB(0, 255, 255)))
panel_4 = Panel([equality.Equality, equality_2.Equality])

# ----
# BAKE ME!
custom_preview_4 = CustomPreview(Geometry=brep_join_2.Breps, Material=colour_swatch)
custom_preview_5 = CustomPreview(Geometry=brep_join.Breps, Material=colour_swatch_2)
