# Grasshopper definition Diagrid Structure.gh (Grasshopper 1.0.7)
# plug-ins: LunchBox

curve = Curve(<curve referenced from the Rhino model>)
brep = Brep(curve)
area = Area(Geometry=brep)  # -> Area, Centroid
triangle_panels_c = TrianglePanelsC(Surface=brep, UDivisions=Slider(10, range=0..10), VDivisions=Slider(10, range=0..10))
area_2 = Area(Geometry=triangle_panels_c)  # -> Area, Centroid
scale = Scale(Geometry=brep, Center=area.Centroid, Factor=Slider(1.017, range=1..2))  # -> Geometry, Transform
scale_2 = Scale(Geometry=triangle_panels_c, Center=area_2.Centroid, Factor=Slider(0.9, range=0..1))  # -> Geometry, Transform
deconstruct_brep = DeconstructBrep(Brep=scale_2.Geometry)  # -> Faces, flatten(Edges), Vertices
geometry = Geometry(deconstruct_brep.Edges)
surface_split = SurfaceSplit(Surface=scale.Geometry, Curves=deconstruct_brep.Edges)
list_item = ListItem(List=surface_split, Index=0, Wrap=True)
unit_z = UnitZ(Factor=Slider(3, range=0..3))
brep_2 = Brep(list_item)
extrude = Extrude(Base=brep_2, Direction=unit_z)
