# Grasshopper definition RoofMillipede_Stress_Test.gh (Grasshopper 1.0.7)
# plug-ins: karambaGH, Millipede

brep = Brep(<brep referenced from the Rhino model>)  # disabled
brep_2 = Brep(<brep referenced from the Rhino model>)
deconstruct_brep = DeconstructBrep(Brep=brep)  # -> Faces, Edges, Vertices; disabled
mesh = Mesh(<mesh referenced from the Rhino model>)
deconstruct_brep_2 = DeconstructBrep(Brep=brep_2)  # -> Faces, Edges, Vertices
number_slider = Slider(0, range=0..5)  # disabled
division = Division(A=Slider(18, range=0..36), B=Slider(12, range=0..100))
point = Point(graft([<point referenced from the Rhino model> x44]))
unit_z = UnitZ(Factor=1)
number_slider_2 = Slider(10, range=0..10)  # disabled
multiplication = Multiplication(A=division, B="2")
list_item = ListItem(List=deconstruct_brep.Faces, Index=number_slider, Wrap=True)  # disabled
list_item_2 = ListItem(List=deconstruct_brep_2.Faces, Index=Slider(0, range=0..5), Wrap=True)
panel = Panel(multiplication)
line_sdl = LineSDL(Start=point, Direction=unit_z, Length=Slider(100, range=0..100))
mesh_breps_karamba3d = MeshBrepsKaramba3D(
    Brep=brep,
    MeshResolution=number_slider_2,
    EdgeRefinementFactor=0.67,
    PointReduction=False,
    SmoothingStepSize=0,
    SmoothingIterations=5)  # -> Mesh, Info; disabled
brep_line = BrepLine(Brep=list_item_2, Line=line_sdl, LimitToFirst=False)  # -> Curves, graft(Points)
unit_z_2 = UnitZ(Factor=Slider(2, range=0..3))
mesh_edges = MeshEdges(Mesh=mesh_breps_karamba3d.Mesh)  # -> NakedEdges, InteriorEdges, NonManifoldEdges; disabled
move = Move(Geometry=brep_line.Points, Motion=unit_z_2)  # -> Geometry, Transform
line = Line(StartPoint=move.Geometry, EndPoint=point)
pipe = Pipe(Curve=line, Radius=division, Caps="1")
mesh_edges_2 = MeshEdges(Mesh=mesh)  # -> NakedEdges, InteriorEdges, NonManifoldEdges
material = Material(MaterialType=5)
unit_z_3 = UnitZ(Factor=Slider(17000, range=0..100000))
brep_3 = Brep(<brep referenced from the Rhino model>)
fe_mesh = FEMesh(Meshes=mesh, Material=material, Thickness=Slider(36, range=0..36), AreaLoad=Vector(0, 0, 0), NormalAreaLoad=0)
msupport_type_region = MSupportTypeRegion(Boundary=pipe, SupportType=63, AmmendExistingSupports=True)
load_region = LoadRegion(Boundary=brep_3, AreaLoad=unit_z_3)
fea_system = FEASystem(
    ModelComponents=flatten([fe_mesh, load_region, msupport_type_region]),
    IntersectAddedCurves=True,
    MergeTolerance=0.0001,
    MinimumCurveSpan=0.05,
    MaximumCurveSpan=10000,
    CurveTolerance=0.1)
fe_solver = FESolver(
    FEModel=fea_system,
    SelfWeightCoefficient=1,
    BeamOptimisationIterations=0,
    QuadOptimisationIterations=Slider(12, range=0..100),
    OptimizationTarget=Slider(0.1, range=0..0.1),
    OptimizationPenalization=2,
    LoadCase=0,
    AllCases=True)  # -> FEModel, MaxDeflection, Weight
popgeo = PopulateGeometry(Geometry=brep_3, Count=Slider(500, range=20..500), Seed=1)
pt = Point(brep_line.Points)
merge = Merge(Data1=popgeo, Data2=pt)
quad_results = QuadResults(FEModel=fe_solver.FEModel, Plane=1)  # -> PrincipalStressFrame, Area, NormalDisplacement, MaxVonMisesStress, PS1, PS2, StiffnessMultiplier, Bending
mesh_visualization = MeshVisualization(FEModel=fe_solver.FEModel, Deflection=0, Plane=1, ShowThickness=False, ColorMode=6)  # -> Mesh, CompleteRange, VisibleRange
stream_filter = StreamFilter(Gate=Toggle(True), Stream0=merge, Stream1=pt)
stress_lines = StressLines(FEModel=fe_solver.FEModel, Points=stream_filter, Plane=1)  # -> Stress1, Stress2
custom_preview = CustomPreview(Geometry=stress_lines.Stress1, Material=ColourSwatch(SwatchColor=RGB(255, 255, 255)))
custom_preview_2 = CustomPreview(Geometry=stress_lines.Stress2, Material=ColourSwatch(SwatchColor=RGB(0, 0, 0)))
panel_2 = Panel("0 to 10")  # disabled
join = JoinCurves(Curves=stress_lines.Stress2, Preserve=False)  # disabled
join_2 = JoinCurves(Curves=stress_lines.Stress1, Preserve=False)  # disabled
subcrv = SubCurve(BaseCurve=join, Domain=panel_2)  # disabled
subcrv_2 = SubCurve(BaseCurve=join_2, Domain=panel_2)  # disabled
smooth_polyline = SmoothPolyline(Polyline=stress_lines.Stress1, Strength=1, Times=1)
stress_pattern = StressPattern(
    FEModel=fe_solver.FEModel,
    Omega=Slider(0.1, range=0..0.1),
    Scalefield=Toggle(True),
    Uselambda=Toggle(True),
    Smoothfactor=Slider(0.99, range=0..1),
    SmoothModulo=1,
    Iterations=Slider(1000, range=0..1000),
    MeshDenisty=1,
    Layer=1,
    Thickness=Slider(7, range=0..10),
    Bending=Toggle(True))
swatch = ColourSwatch(SwatchColor=RGB(255, 255, 255))  # disabled
swatch_2 = ColourSwatch(SwatchColor=RGB(255, 255, 255))  # disabled
swatch_3 = ColourSwatch(SwatchColor=RGB(255, 0, 0))  # disabled
swatch_4 = ColourSwatch(SwatchColor=RGB(0, 0, 255))  # disabled
preview = CustomPreview(Geometry=subcrv, Shader=swatch_3)  # disabled
preview_2 = CustomPreview(Geometry=subcrv_2, Shader=swatch_4)  # disabled
curves = Curves(System=stress_pattern)
quads = Quads(System=stress_pattern)
vector_field = VectorField(System=stress_pattern)  # -> Points, Vectors
