# Grasshopper definition X12 - Energy Analysis.gh (Grasshopper 1.0.7)
# plug-ins: ItemSelector, Wallacei

# ----
# WOODSHOP
# Construction Set
# Walls
# Windows
# Floor/Roof
brep = Brep([<brep referenced from the Rhino model> x10])
bldgprograms = HBBuildingPrograms({"LargeOffice", "MediumOffice", "SmallOffice", "MidriseApartment", "HighriseApartment", "Retail", "StripMall", "PrimarySchool", "SecondarySchool", "SmallHotel", "LargeHotel", "Hospital", "Outpatient", "Laboratory", "Warehouse", "SuperMarket", "FullServiceRestaurant", "QuickServiceRestaurant", "Courthouse", "LargeDataCenterHighITE", "LargeDataCenterLowITE", "SmallDataCenterHighITE", "SmallDataCenterLowITE"}, selected="SecondarySchool")
panel = Panel("""0
9""")
panel_2 = Panel("""8
5
6
7""")
area = Area(Geometry=brep)  # -> Area, Centroid
join = BrepJoin(Breps=brep)  # -> Breps, Closed
cull_i = CullIndex(List=brep, Indices=[panel_2, panel], Wrap=True)
item = ListItem(List=brep, Index=panel_2, Wrap=True)
item_2 = ListItem(List=brep, Index=panel, Wrap=True)
searchprog = HBSearchPrograms(bldg_prog=bldgprograms)  # -> room_prog; plug-in component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
points = PointList(Points=area.Centroid, Size=Slider(0.45, range=0..1))
list = Honeybee_ItemSelector(
    searchprog,
    {"2013::SecondarySchool::Auditorium", "2013::SecondarySchool::Cafeteria", "2013::SecondarySchool::Classroom", "2013::SecondarySchool::ComputerRoom", "2013::SecondarySchool::Corridor", "2013::SecondarySchool::Gym", "2013::SecondarySchool::Kitchen", "2013::SecondarySchool::Library", "2013::SecondarySchool::Lobby", "2013::SecondarySchool::Mechanical", "2013::SecondarySchool::Office", "2013::SecondarySchool::Restroom"}, selected="2013::SecondarySchool::Classroom")
panel_3 = Panel(searchprog)
window_ratio = Slider(0.99, range=0.1..1.1)
geo = Geometry(item_2)
geo_2 = Geometry(item)
geo_3 = Geometry(cull_i)
face = HBFace(geo=geo, bc="outdoors")  # -> report, faces; plug-in component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
face_2 = HBFace(geo=geo_3, bc="outdoors")  # -> report, faces; plug-in component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
face_3 = HBFace(geo=geo_2, bc="outdoors")  # -> report, faces; plug-in component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
bldgvintages = HBBuildingVintages({"ASHRAE 90.1 2013  |  IECC 2015": "2013", "ASHRAE 90.1 2010  |  IECC 2012": "2010", "ASHRAE 90.1 2007  |  IECC 2009": "2007", "ASHRAE 90.1 2004  |  IECC 2006": "2004", "1980-2004 (CBECS)": "1980_2004", "Pre-1980 (CBECS)": "pre_1980"}, selected="ASHRAE 90.1 2013  |  IECC 2015")
climatezones = HBClimateZones({"1 - Very Hot": "1", "2 - Hot": "2", "3 - Warm": "3", "4 - Mixed": "4", "5 - Cool": "5", "6 - Cold": "6", "7 - Very Cold": "7", "8 - Subarctic": "8"}, selected="3 - Warm")
constr_type = Dragonfly_BldgAge({"SteelFramed", "WoodFramed", "Mass", "Metal Building"}, selected="Mass")
aperturesbyratio = HBAperturesByRatio(hb_objs=flatten(face_3.faces), ratio=window_ratio, subdivide=Toggle(False), operable=Toggle(True))  # -> report, hb_objs; plug-in component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
constrsetclimate = HBConstructionSetByClimate(climate_zone=climatezones, vintage=bldgvintages, constr_type=constr_type)  # -> constr_set; plug-in component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
merge = Merge(Data1=face_2.faces, Data2=aperturesbyratio.hb_objs, Data3=face.faces)
room = HBRoom(faces=flatten(merge), name="WOODSHOP", constr_set=constrsetclimate, program=list, conditioned=Toggle(True))  # -> report, room; plug-in component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

# ----
# Mechanical
# Construction Set
# Walls
bldgprograms_2 = HBBuildingPrograms({"LargeOffice", "MediumOffice", "SmallOffice", "MidriseApartment", "HighriseApartment", "Retail", "StripMall", "PrimarySchool", "SecondarySchool", "SmallHotel", "LargeHotel", "Hospital", "Outpatient", "Laboratory", "Warehouse", "SuperMarket", "FullServiceRestaurant", "QuickServiceRestaurant", "Courthouse", "LargeDataCenterHighITE", "LargeDataCenterLowITE", "SmallDataCenterHighITE", "SmallDataCenterLowITE"}, selected="SecondarySchool")
brep_2 = Brep([<brep referenced from the Rhino model> x8])
area_2 = Area(Geometry=brep_2)  # -> Area, Centroid
searchprog_2 = HBSearchPrograms(bldg_prog=bldgprograms_2)  # -> room_prog; plug-in component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
join_2 = BrepJoin(Breps=brep_2)  # -> Breps, Closed
list_2 = Honeybee_ItemSelector(
    searchprog_2,
    {"2013::SecondarySchool::Auditorium", "2013::SecondarySchool::Cafeteria", "2013::SecondarySchool::Classroom", "2013::SecondarySchool::ComputerRoom", "2013::SecondarySchool::Corridor", "2013::SecondarySchool::Gym", "2013::SecondarySchool::Kitchen", "2013::SecondarySchool::Library", "2013::SecondarySchool::Lobby", "2013::SecondarySchool::Mechanical", "2013::SecondarySchool::Office", "2013::SecondarySchool::Restroom"}, selected="2013::SecondarySchool::Mechanical")
points_2 = PointList(Points=area_2.Centroid, Size=Slider(0.67, range=0..1))
panel_4 = Panel(searchprog_2)
geo_4 = Geometry(join_2.Breps)
face_4 = HBFace(geo=geo_4, bc="outdoors")  # -> report, faces; plug-in component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
bldgvintages_2 = HBBuildingVintages({"ASHRAE 90.1 2013  |  IECC 2015": "2013", "ASHRAE 90.1 2010  |  IECC 2012": "2010", "ASHRAE 90.1 2007  |  IECC 2009": "2007", "ASHRAE 90.1 2004  |  IECC 2006": "2004", "1980-2004 (CBECS)": "1980_2004", "Pre-1980 (CBECS)": "pre_1980"}, selected="ASHRAE 90.1 2013  |  IECC 2015")
climatezones_2 = HBClimateZones({"1 - Very Hot": "1", "2 - Hot": "2", "3 - Warm": "3", "4 - Mixed": "4", "5 - Cool": "5", "6 - Cold": "6", "7 - Very Cold": "7", "8 - Subarctic": "8"}, selected="3 - Warm")
constr_type_2 = Dragonfly_BldgAge({"SteelFramed", "WoodFramed", "Mass", "Metal Building"}, selected="Mass")
constrsetclimate_2 = HBConstructionSetByClimate(climate_zone=climatezones_2, vintage=bldgvintages_2, constr_type=constr_type_2)  # -> constr_set; plug-in component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
room_2 = HBRoom(faces=flatten(face_4.faces), name="MECHANICAL", constr_set=constrsetclimate_2, program=list_2, conditioned=Toggle(True))  # -> report, room; plug-in component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

# ----
# CERAMICS
bldgprograms_3 = HBBuildingPrograms({"LargeOffice", "MediumOffice", "SmallOffice", "MidriseApartment", "HighriseApartment", "Retail", "StripMall", "PrimarySchool", "SecondarySchool", "SmallHotel", "LargeHotel", "Hospital", "Outpatient", "Laboratory", "Warehouse", "SuperMarket", "FullServiceRestaurant", "QuickServiceRestaurant", "Courthouse", "LargeDataCenterHighITE", "LargeDataCenterLowITE", "SmallDataCenterHighITE", "SmallDataCenterLowITE"}, selected="SecondarySchool")
brep_3 = Brep([<brep referenced from the Rhino model> x10])
panel_5 = Panel("""0
1""")
panel_6 = Panel("""6
7
8
9""")
area_3 = Area(Geometry=brep_3)  # -> Area, Centroid
join_3 = BrepJoin(Breps=brep_3)  # -> Breps, Closed
cull_i_2 = CullIndex(List=brep_3, Indices=[panel_6, panel_5], Wrap=True)
item_3 = ListItem(List=brep_3, Index=panel_6, Wrap=True)
item_4 = ListItem(List=brep_3, Index=panel_5, Wrap=True)
searchprog_3 = HBSearchPrograms(bldg_prog=bldgprograms_3)  # -> room_prog; plug-in component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
points_3 = PointList(Points=area_3.Centroid, Size=Slider(0.46, range=0..1))
list_3 = Honeybee_ItemSelector(
    searchprog_3,
    {"2013::SecondarySchool::Auditorium", "2013::SecondarySchool::Cafeteria", "2013::SecondarySchool::Classroom", "2013::SecondarySchool::ComputerRoom", "2013::SecondarySchool::Corridor", "2013::SecondarySchool::Gym", "2013::SecondarySchool::Kitchen", "2013::SecondarySchool::Library", "2013::SecondarySchool::Lobby", "2013::SecondarySchool::Mechanical", "2013::SecondarySchool::Office", "2013::SecondarySchool::Restroom"}, selected="2013::SecondarySchool::Classroom")
panel_7 = Panel(searchprog_3)
window_ratio_2 = Slider(0.99, range=0.1..1.1)
geo_5 = Geometry(item_4)
geo_6 = Geometry(item_3)
geo_7 = Geometry(cull_i_2)
face_5 = HBFace(geo=geo_5, bc="outdoors")  # -> report, faces; plug-in component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
face_6 = HBFace(geo=geo_7, bc="outdoors")  # -> report, faces; plug-in component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
face_7 = HBFace(geo=geo_6, bc="outdoors")  # -> report, faces; plug-in component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
bldgvintages_3 = HBBuildingVintages({"ASHRAE 90.1 2013  |  IECC 2015": "2013", "ASHRAE 90.1 2010  |  IECC 2012": "2010", "ASHRAE 90.1 2007  |  IECC 2009": "2007", "ASHRAE 90.1 2004  |  IECC 2006": "2004", "1980-2004 (CBECS)": "1980_2004", "Pre-1980 (CBECS)": "pre_1980"}, selected="ASHRAE 90.1 2013  |  IECC 2015")
climatezones_3 = HBClimateZones({"1 - Very Hot": "1", "2 - Hot": "2", "3 - Warm": "3", "4 - Mixed": "4", "5 - Cool": "5", "6 - Cold": "6", "7 - Very Cold": "7", "8 - Subarctic": "8"}, selected="3 - Warm")
constr_type_3 = Dragonfly_BldgAge({"SteelFramed", "WoodFramed", "Mass", "Metal Building"}, selected="Mass")
aperturesbyratio_2 = HBAperturesByRatio(hb_objs=flatten(face_7.faces), ratio=window_ratio_2, subdivide=Toggle(False), operable=Toggle(True))  # -> report, hb_objs; plug-in component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
constrsetclimate_3 = HBConstructionSetByClimate(climate_zone=climatezones_3, vintage=bldgvintages_3, constr_type=constr_type_3)  # -> constr_set; plug-in component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
merge_2 = Merge(Data1=face_6.faces, Data2=aperturesbyratio_2.hb_objs, Data3=face_5.faces)
room_3 = HBRoom(faces=flatten(merge_2), name="CERAMICS", constr_set=constrsetclimate_3, program=list_3, conditioned=Toggle(True))  # -> report, room; plug-in component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

# ----
# STUDIO-ART/PHOTO
bldgprograms_4 = HBBuildingPrograms({"LargeOffice", "MediumOffice", "SmallOffice", "MidriseApartment", "HighriseApartment", "Retail", "StripMall", "PrimarySchool", "SecondarySchool", "SmallHotel", "LargeHotel", "Hospital", "Outpatient", "Laboratory", "Warehouse", "SuperMarket", "FullServiceRestaurant", "QuickServiceRestaurant", "Courthouse", "LargeDataCenterHighITE", "LargeDataCenterLowITE", "SmallDataCenterHighITE", "SmallDataCenterLowITE"}, selected="SecondarySchool")
brep_4 = Brep([<brep referenced from the Rhino model> x14])
panel_8 = Panel("""0
1""")
panel_9 = Panel("""9
10
11
12
13
8""")
area_4 = Area(Geometry=brep_4)  # -> Area, Centroid
join_4 = BrepJoin(Breps=brep_4)  # -> Breps, Closed
cull_i_3 = CullIndex(List=brep_4, Indices=[panel_9, panel_8], Wrap=True)
item_5 = ListItem(List=brep_4, Index=panel_9, Wrap=True)
item_6 = ListItem(List=brep_4, Index=panel_8, Wrap=True)
searchprog_4 = HBSearchPrograms(bldg_prog=bldgprograms_4)  # -> room_prog; plug-in component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
points_4 = PointList(Points=area_4.Centroid, Size=Slider(0.37, range=0..1))
list_4 = Honeybee_ItemSelector(
    searchprog_4,
    {"2013::SecondarySchool::Auditorium", "2013::SecondarySchool::Cafeteria", "2013::SecondarySchool::Classroom", "2013::SecondarySchool::ComputerRoom", "2013::SecondarySchool::Corridor", "2013::SecondarySchool::Gym", "2013::SecondarySchool::Kitchen", "2013::SecondarySchool::Library", "2013::SecondarySchool::Lobby", "2013::SecondarySchool::Mechanical", "2013::SecondarySchool::Office", "2013::SecondarySchool::Restroom"}, selected="2013::SecondarySchool::Classroom")
panel_10 = Panel(searchprog_4)
window_ratio_3 = Slider(0.99, range=0.1..1.1)
geo_8 = Geometry(item_6)
geo_9 = Geometry(item_5)
geo_10 = Geometry(cull_i_3)
face_8 = HBFace(geo=geo_8, bc="outdoors")  # -> report, faces; plug-in component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
face_9 = HBFace(geo=geo_10, bc="outdoors")  # -> report, faces; plug-in component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
face_10 = HBFace(geo=geo_9, bc="outdoors")  # -> report, faces; plug-in component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
bldgvintages_4 = HBBuildingVintages({"ASHRAE 90.1 2013  |  IECC 2015": "2013", "ASHRAE 90.1 2010  |  IECC 2012": "2010", "ASHRAE 90.1 2007  |  IECC 2009": "2007", "ASHRAE 90.1 2004  |  IECC 2006": "2004", "1980-2004 (CBECS)": "1980_2004", "Pre-1980 (CBECS)": "pre_1980"}, selected="ASHRAE 90.1 2013  |  IECC 2015")
climatezones_4 = HBClimateZones({"1 - Very Hot": "1", "2 - Hot": "2", "3 - Warm": "3", "4 - Mixed": "4", "5 - Cool": "5", "6 - Cold": "6", "7 - Very Cold": "7", "8 - Subarctic": "8"}, selected="3 - Warm")
constr_type_4 = Dragonfly_BldgAge({"SteelFramed", "WoodFramed", "Mass", "Metal Building"}, selected="Mass")
aperturesbyratio_3 = HBAperturesByRatio(hb_objs=flatten(face_10.faces), ratio=window_ratio_3, subdivide=Toggle(False), operable=Toggle(True))  # -> report, hb_objs; plug-in component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
constrsetclimate_4 = HBConstructionSetByClimate(climate_zone=climatezones_4, vintage=bldgvintages_4, constr_type=constr_type_4)  # -> constr_set; plug-in component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
merge_3 = Merge(Data1=face_9.faces, Data2=aperturesbyratio_3.hb_objs, Data3=face_8.faces)
room_4 = HBRoom(faces=flatten(merge_3), name="STUDIOARTPHOTO", constr_set=constrsetclimate_4, program=list_4, conditioned=Toggle(True))  # -> report, room; plug-in component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

# ----
# STUDIO - AV LAB
bldgprograms_5 = HBBuildingPrograms({"LargeOffice", "MediumOffice", "SmallOffice", "MidriseApartment", "HighriseApartment", "Retail", "StripMall", "PrimarySchool", "SecondarySchool", "SmallHotel", "LargeHotel", "Hospital", "Outpatient", "Laboratory", "Warehouse", "SuperMarket", "FullServiceRestaurant", "QuickServiceRestaurant", "Courthouse", "LargeDataCenterHighITE", "LargeDataCenterLowITE", "SmallDataCenterHighITE", "SmallDataCenterLowITE"}, selected="SecondarySchool")
brep_5 = Brep([<brep referenced from the Rhino model> x10])
panel_11 = Panel("""0
1""")
panel_12 = Panel("""6
7
8
9""")
area_5 = Area(Geometry=brep_5)  # -> Area, Centroid
join_5 = BrepJoin(Breps=brep_5)  # -> Breps, Closed
cull_i_4 = CullIndex(List=brep_5, Indices=[panel_12, panel_11], Wrap=True)
item_7 = ListItem(List=brep_5, Index=panel_12, Wrap=True)
item_8 = ListItem(List=brep_5, Index=panel_11, Wrap=True)
searchprog_5 = HBSearchPrograms(bldg_prog=bldgprograms_5)  # -> room_prog; plug-in component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
points_5 = PointList(Points=area_5.Centroid, Size=Slider(0.52, range=0..1))
list_5 = Honeybee_ItemSelector(
    searchprog_5,
    {"2013::SecondarySchool::Auditorium", "2013::SecondarySchool::Cafeteria", "2013::SecondarySchool::Classroom", "2013::SecondarySchool::ComputerRoom", "2013::SecondarySchool::Corridor", "2013::SecondarySchool::Gym", "2013::SecondarySchool::Kitchen", "2013::SecondarySchool::Library", "2013::SecondarySchool::Lobby", "2013::SecondarySchool::Mechanical", "2013::SecondarySchool::Office", "2013::SecondarySchool::Restroom"}, selected="2013::SecondarySchool::Classroom")
panel_13 = Panel(searchprog_5)
window_ratio_4 = Slider(0.99, range=0.1..1.1)
geo_11 = Geometry(item_8)
geo_12 = Geometry(item_7)
geo_13 = Geometry(cull_i_4)
face_11 = HBFace(geo=geo_11, bc="outdoors")  # -> report, faces; plug-in component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
face_12 = HBFace(geo=geo_13, bc="outdoors")  # -> report, faces; plug-in component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
face_13 = HBFace(geo=geo_12, bc="outdoors")  # -> report, faces; plug-in component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
bldgvintages_5 = HBBuildingVintages({"ASHRAE 90.1 2013  |  IECC 2015": "2013", "ASHRAE 90.1 2010  |  IECC 2012": "2010", "ASHRAE 90.1 2007  |  IECC 2009": "2007", "ASHRAE 90.1 2004  |  IECC 2006": "2004", "1980-2004 (CBECS)": "1980_2004", "Pre-1980 (CBECS)": "pre_1980"}, selected="ASHRAE 90.1 2013  |  IECC 2015")
climatezones_5 = HBClimateZones({"1 - Very Hot": "1", "2 - Hot": "2", "3 - Warm": "3", "4 - Mixed": "4", "5 - Cool": "5", "6 - Cold": "6", "7 - Very Cold": "7", "8 - Subarctic": "8"}, selected="3 - Warm")
constr_type_5 = Dragonfly_BldgAge({"SteelFramed", "WoodFramed", "Mass", "Metal Building"}, selected="Mass")
aperturesbyratio_4 = HBAperturesByRatio(hb_objs=flatten(face_13.faces), ratio=window_ratio_4, subdivide=Toggle(False), operable=Toggle(True))  # -> report, hb_objs; plug-in component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
constrsetclimate_5 = HBConstructionSetByClimate(climate_zone=climatezones_5, vintage=bldgvintages_5, constr_type=constr_type_5)  # -> constr_set; plug-in component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
merge_4 = Merge(Data1=face_12.faces, Data2=aperturesbyratio_4.hb_objs, Data3=face_11.faces)
room_5 = HBRoom(faces=flatten(merge_4), name="STUDIO-AV-LAB", constr_set=constrsetclimate_5, program=list_5, conditioned=Toggle(True))  # -> report, room; plug-in component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

# ----
# METALSHOP
bldgprograms_6 = HBBuildingPrograms({"LargeOffice", "MediumOffice", "SmallOffice", "MidriseApartment", "HighriseApartment", "Retail", "StripMall", "PrimarySchool", "SecondarySchool", "SmallHotel", "LargeHotel", "Hospital", "Outpatient", "Laboratory", "Warehouse", "SuperMarket", "FullServiceRestaurant", "QuickServiceRestaurant", "Courthouse", "LargeDataCenterHighITE", "LargeDataCenterLowITE", "SmallDataCenterHighITE", "SmallDataCenterLowITE"}, selected="SecondarySchool")
brep_6 = Brep([<brep referenced from the Rhino model> x10])
panel_14 = Panel("""4
5""")
panel_15 = Panel("""0
1
2
3""")
area_6 = Area(Geometry=brep_6)  # -> Area, Centroid
join_6 = BrepJoin(Breps=brep_6)  # -> Breps, Closed
cull_i_5 = CullIndex(List=brep_6, Indices=[panel_15, panel_14], Wrap=True)
item_9 = ListItem(List=brep_6, Index=panel_15, Wrap=True)
item_10 = ListItem(List=brep_6, Index=panel_14, Wrap=True)
searchprog_6 = HBSearchPrograms(bldg_prog=bldgprograms_6)  # -> room_prog; plug-in component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
points_6 = PointList(Points=area_6.Centroid, Size=Slider(0.29, range=0..1))
list_6 = Honeybee_ItemSelector(
    searchprog_6,
    {"2013::SecondarySchool::Auditorium", "2013::SecondarySchool::Cafeteria", "2013::SecondarySchool::Classroom", "2013::SecondarySchool::ComputerRoom", "2013::SecondarySchool::Corridor", "2013::SecondarySchool::Gym", "2013::SecondarySchool::Kitchen", "2013::SecondarySchool::Library", "2013::SecondarySchool::Lobby", "2013::SecondarySchool::Mechanical", "2013::SecondarySchool::Office", "2013::SecondarySchool::Restroom"}, selected="2013::SecondarySchool::Classroom")
panel_16 = Panel(searchprog_6)
window_ratio_5 = Slider(0.99, range=0.1..1.1)
geo_14 = Geometry(item_10)
geo_15 = Geometry(item_9)
geo_16 = Geometry(cull_i_5)
face_14 = HBFace(geo=geo_14, bc="outdoors")  # -> report, faces; plug-in component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
face_15 = HBFace(geo=geo_16, bc="outdoors")  # -> report, faces; plug-in component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
face_16 = HBFace(geo=geo_15, bc="outdoors")  # -> report, faces; plug-in component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
bldgvintages_6 = HBBuildingVintages({"ASHRAE 90.1 2013  |  IECC 2015": "2013", "ASHRAE 90.1 2010  |  IECC 2012": "2010", "ASHRAE 90.1 2007  |  IECC 2009": "2007", "ASHRAE 90.1 2004  |  IECC 2006": "2004", "1980-2004 (CBECS)": "1980_2004", "Pre-1980 (CBECS)": "pre_1980"}, selected="ASHRAE 90.1 2013  |  IECC 2015")
climatezones_6 = HBClimateZones({"1 - Very Hot": "1", "2 - Hot": "2", "3 - Warm": "3", "4 - Mixed": "4", "5 - Cool": "5", "6 - Cold": "6", "7 - Very Cold": "7", "8 - Subarctic": "8"}, selected="3 - Warm")
constr_type_6 = Dragonfly_BldgAge({"SteelFramed", "WoodFramed", "Mass", "Metal Building"}, selected="Mass")
aperturesbyratio_5 = HBAperturesByRatio(hb_objs=flatten(face_16.faces), ratio=window_ratio_5, subdivide=Toggle(False), operable=Toggle(True))  # -> report, hb_objs; plug-in component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
constrsetclimate_6 = HBConstructionSetByClimate(climate_zone=climatezones_6, vintage=bldgvintages_6, constr_type=constr_type_6)  # -> constr_set; plug-in component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
merge_5 = Merge(Data1=face_15.faces, Data2=aperturesbyratio_5.hb_objs, Data3=face_14.faces)
room_6 = HBRoom(faces=flatten(merge_5), name="METALSHOP", constr_set=constrsetclimate_6, program=list_6, conditioned=Toggle(True))  # -> report, room; plug-in component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

# ----
# DIGITAL FABRICATION
bldgprograms_7 = HBBuildingPrograms({"LargeOffice", "MediumOffice", "SmallOffice", "MidriseApartment", "HighriseApartment", "Retail", "StripMall", "PrimarySchool", "SecondarySchool", "SmallHotel", "LargeHotel", "Hospital", "Outpatient", "Laboratory", "Warehouse", "SuperMarket", "FullServiceRestaurant", "QuickServiceRestaurant", "Courthouse", "LargeDataCenterHighITE", "LargeDataCenterLowITE", "SmallDataCenterHighITE", "SmallDataCenterLowITE"}, selected="SecondarySchool")
brep_7 = Brep([<brep referenced from the Rhino model> x18])
panel_17 = Panel("""2
3
4
17
10
11
12
13""")
panel_18 = Panel("""0
1""")
area_7 = Area(Geometry=brep_7)  # -> Area, Centroid
join_7 = BrepJoin(Breps=brep_7)  # -> Breps, Closed
cull_i_6 = CullIndex(List=brep_7, Indices=[panel_17, panel_18], Wrap=True)
item_11 = ListItem(List=brep_7, Index=panel_17, Wrap=True)
item_12 = ListItem(List=brep_7, Index=panel_18, Wrap=True)
searchprog_7 = HBSearchPrograms(bldg_prog=bldgprograms_7)  # -> room_prog; plug-in component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
points_7 = PointList(Points=area_7.Centroid, Size=Slider(0.38, range=0..1))
list_7 = Honeybee_ItemSelector(
    searchprog_7,
    {"2013::SecondarySchool::Auditorium", "2013::SecondarySchool::Cafeteria", "2013::SecondarySchool::Classroom", "2013::SecondarySchool::ComputerRoom", "2013::SecondarySchool::Corridor", "2013::SecondarySchool::Gym", "2013::SecondarySchool::Kitchen", "2013::SecondarySchool::Library", "2013::SecondarySchool::Lobby", "2013::SecondarySchool::Mechanical", "2013::SecondarySchool::Office", "2013::SecondarySchool::Restroom"}, selected="2013::SecondarySchool::ComputerRoom")
panel_19 = Panel(searchprog_7)
window_ratio_6 = Slider(0.99, range=0.1..1.1)
geo_17 = Geometry(item_12)
geo_18 = Geometry(item_11)
geo_19 = Geometry(cull_i_6)
face_17 = HBFace(geo=geo_17, bc="outdoors")  # -> report, faces; plug-in component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
face_18 = HBFace(geo=geo_19, bc="outdoors")  # -> report, faces; plug-in component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
face_19 = HBFace(geo=geo_18, bc="outdoors")  # -> report, faces; plug-in component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
bldgvintages_7 = HBBuildingVintages({"ASHRAE 90.1 2013  |  IECC 2015": "2013", "ASHRAE 90.1 2010  |  IECC 2012": "2010", "ASHRAE 90.1 2007  |  IECC 2009": "2007", "ASHRAE 90.1 2004  |  IECC 2006": "2004", "1980-2004 (CBECS)": "1980_2004", "Pre-1980 (CBECS)": "pre_1980"}, selected="ASHRAE 90.1 2013  |  IECC 2015")
climatezones_7 = HBClimateZones({"1 - Very Hot": "1", "2 - Hot": "2", "3 - Warm": "3", "4 - Mixed": "4", "5 - Cool": "5", "6 - Cold": "6", "7 - Very Cold": "7", "8 - Subarctic": "8"}, selected="3 - Warm")
constr_type_7 = Dragonfly_BldgAge({"SteelFramed", "WoodFramed", "Mass", "Metal Building"}, selected="Mass")
aperturesbyratio_6 = HBAperturesByRatio(hb_objs=flatten(face_19.faces), ratio=window_ratio_6, subdivide=Toggle(False), operable=Toggle(True))  # -> report, hb_objs; plug-in component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
constrsetclimate_7 = HBConstructionSetByClimate(climate_zone=climatezones_7, vintage=bldgvintages_7, constr_type=constr_type_7)  # -> constr_set; plug-in component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
merge_6 = Merge(Data1=face_18.faces, Data2=aperturesbyratio_6.hb_objs, Data3=face_17.faces)
room_7 = HBRoom(
    faces=flatten(merge_6),
    name="DIGITALFABRICATION",
    constr_set=constrsetclimate_7,
    program=list_7,
    conditioned=Toggle(True))  # -> report, room; plug-in component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

# ---- group: Chage Glazing Ratio, Orientation, and Program
window_ratio_7 = Slider(0.99, range=0.1..1.1)

# ----
# Construction Set
bldgvintages_8 = HBBuildingVintages({"ASHRAE 90.1 2013  |  IECC 2015": "2013", "ASHRAE 90.1 2010  |  IECC 2012": "2010", "ASHRAE 90.1 2007  |  IECC 2009": "2007", "ASHRAE 90.1 2004  |  IECC 2006": "2004", "1980-2004 (CBECS)": "1980_2004", "Pre-1980 (CBECS)": "pre_1980"}, selected="ASHRAE 90.1 2013  |  IECC 2015")
climatezones_8 = HBClimateZones({"1 - Very Hot": "1", "2 - Hot": "2", "3 - Warm": "3", "4 - Mixed": "4", "5 - Cool": "5", "6 - Cold": "6", "7 - Very Cold": "7", "8 - Subarctic": "8"}, selected="3 - Warm")
constr_type_8 = Dragonfly_BldgAge({"SteelFramed", "WoodFramed", "Mass", "Metal Building"}, selected="Mass")
constrsetclimate_8 = HBConstructionSetByClimate(climate_zone=climatezones_8, vintage=bldgvintages_8, constr_type=constr_type_8)  # -> constr_set; plug-in component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

# ----
# Browse ConstructionSets
# Create New ConstructionSet
# HELP/SUPPLIES
bldgprograms_8 = HBBuildingPrograms({"LargeOffice", "MediumOffice", "SmallOffice", "MidriseApartment", "HighriseApartment", "Retail", "StripMall", "PrimarySchool", "SecondarySchool", "SmallHotel", "LargeHotel", "Hospital", "Outpatient", "Laboratory", "Warehouse", "SuperMarket", "FullServiceRestaurant", "QuickServiceRestaurant", "Courthouse", "LargeDataCenterHighITE", "LargeDataCenterLowITE", "SmallDataCenterHighITE", "SmallDataCenterLowITE"}, selected="SecondarySchool")
brep_8 = Brep([<brep referenced from the Rhino model> x20])
panel_20 = Panel("""0
1""")
panel_21 = Panel("""19
10
9
2
3
12
16""")
area_8 = Area(Geometry=brep_8)  # -> Area, Centroid
join_8 = BrepJoin(Breps=brep_8)  # -> Breps, Closed
cull_i_7 = CullIndex(List=brep_8, Indices=[panel_21, panel_20], Wrap=True)
# Glass
item_13 = ListItem(List=brep_8, Index=panel_21, Wrap=True)
item_14 = ListItem(List=brep_8, Index=panel_20, Wrap=True)
searchprog_8 = HBSearchPrograms(bldg_prog=bldgprograms_8)  # -> room_prog; plug-in component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
points_8 = PointList(Points=area_8.Centroid, Size=Slider(0.17, range=0..1))
# Deconstruct ConstructionSet, Constructions, Materials
# Apply Constructions
# to Objects
list_8 = Honeybee_ItemSelector(
    searchprog_8,
    {"2013::SecondarySchool::Auditorium", "2013::SecondarySchool::Cafeteria", "2013::SecondarySchool::Classroom", "2013::SecondarySchool::ComputerRoom", "2013::SecondarySchool::Corridor", "2013::SecondarySchool::Gym", "2013::SecondarySchool::Kitchen", "2013::SecondarySchool::Library", "2013::SecondarySchool::Lobby", "2013::SecondarySchool::Mechanical", "2013::SecondarySchool::Office", "2013::SecondarySchool::Restroom"}, selected="2013::SecondarySchool::Classroom")
panel_22 = Panel(searchprog_8)
geo_20 = Geometry(item_14)
# Windows
geo_21 = Geometry(item_13)
# Floor/Roof
panel_23 = Panel("outdoors")
# Walls
geo_22 = Geometry(cull_i_7)
face_20 = HBFace(geo=geo_20, bc="outdoors")  # -> report, faces; plug-in component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
face_21 = HBFace(geo=geo_22, bc="outdoors")  # -> report, faces; plug-in component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
face_22 = HBFace(geo=geo_21, bc=panel_23)  # -> report, faces; plug-in component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
aperturesbyratio_7 = HBAperturesByRatio(hb_objs=flatten(face_22.faces), ratio=window_ratio_7, subdivide=Toggle(False), operable=Toggle(True))  # -> report, hb_objs; plug-in component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
merge_7 = Merge(Data1=face_21.faces, Data2=aperturesbyratio_7.hb_objs, Data3=face_20.faces)
room_8 = HBRoom(faces=flatten(merge_7), name="HELPSUPPLIES", constr_set=constrsetclimate_8, program=list_8, conditioned=Toggle(True))  # -> report, room; plug-in component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

# ----
# Create Materials
setepzonecnstr = Honeybee_SetEPZoneConstruction()  # -> simplify(modifiedHBZones); plug-in component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

# ----
# ADMIN OFFICES
bldgprograms_9 = HBBuildingPrograms({"LargeOffice", "MediumOffice", "SmallOffice", "MidriseApartment", "HighriseApartment", "Retail", "StripMall", "PrimarySchool", "SecondarySchool", "SmallHotel", "LargeHotel", "Hospital", "Outpatient", "Laboratory", "Warehouse", "SuperMarket", "FullServiceRestaurant", "QuickServiceRestaurant", "Courthouse", "LargeDataCenterHighITE", "LargeDataCenterLowITE", "SmallDataCenterHighITE", "SmallDataCenterLowITE"}, selected="SecondarySchool")
brep_9 = Brep([<brep referenced from the Rhino model> x16])
panel_24 = Panel("""0
1""")
panel_25 = Panel("""13
14
15
9
10
7
11
12""")
area_9 = Area(Geometry=brep_9)  # -> Area, Centroid
join_9 = BrepJoin(Breps=brep_9)  # -> Breps, Closed
cull_i_8 = CullIndex(List=brep_9, Indices=[panel_25, panel_24], Wrap=True)
item_15 = ListItem(List=brep_9, Index=panel_25, Wrap=True)
item_16 = ListItem(List=brep_9, Index=panel_24, Wrap=True)
searchprog_9 = HBSearchPrograms(bldg_prog=bldgprograms_9)  # -> room_prog; plug-in component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
points_9 = PointList(Points=area_9.Centroid, Size=Slider(0.62, range=0..1))
list_9 = Honeybee_ItemSelector(
    searchprog_9,
    {"2013::SecondarySchool::Auditorium", "2013::SecondarySchool::Cafeteria", "2013::SecondarySchool::Classroom", "2013::SecondarySchool::ComputerRoom", "2013::SecondarySchool::Corridor", "2013::SecondarySchool::Gym", "2013::SecondarySchool::Kitchen", "2013::SecondarySchool::Library", "2013::SecondarySchool::Lobby", "2013::SecondarySchool::Mechanical", "2013::SecondarySchool::Office", "2013::SecondarySchool::Restroom"}, selected="2013::SecondarySchool::Office")
panel_26 = Panel(searchprog_9)
window_ratio_8 = Slider(0.99, range=0.1..1.1)
geo_23 = Geometry(item_16)
geo_24 = Geometry(item_15)
geo_25 = Geometry(cull_i_8)
face_23 = HBFace(geo=geo_23, bc="outdoors")  # -> report, faces; plug-in component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
face_24 = HBFace(geo=geo_25, bc="outdoors")  # -> report, faces; plug-in component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
face_25 = HBFace(geo=geo_24, bc="outdoors")  # -> report, faces; plug-in component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
bldgvintages_9 = HBBuildingVintages({"ASHRAE 90.1 2013  |  IECC 2015": "2013", "ASHRAE 90.1 2010  |  IECC 2012": "2010", "ASHRAE 90.1 2007  |  IECC 2009": "2007", "ASHRAE 90.1 2004  |  IECC 2006": "2004", "1980-2004 (CBECS)": "1980_2004", "Pre-1980 (CBECS)": "pre_1980"}, selected="ASHRAE 90.1 2013  |  IECC 2015")
climatezones_9 = HBClimateZones({"1 - Very Hot": "1", "2 - Hot": "2", "3 - Warm": "3", "4 - Mixed": "4", "5 - Cool": "5", "6 - Cold": "6", "7 - Very Cold": "7", "8 - Subarctic": "8"}, selected="3 - Warm")
constr_type_9 = Dragonfly_BldgAge({"SteelFramed", "WoodFramed", "Mass", "Metal Building"}, selected="Mass")
aperturesbyratio_8 = HBAperturesByRatio(hb_objs=flatten(face_25.faces), ratio=window_ratio_8, subdivide=Toggle(False), operable=Toggle(True))  # -> report, hb_objs; plug-in component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
constrsetclimate_9 = HBConstructionSetByClimate(climate_zone=climatezones_9, vintage=bldgvintages_9, constr_type=constr_type_9)  # -> constr_set; plug-in component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
merge_8 = Merge(Data1=face_24.faces, Data2=aperturesbyratio_8.hb_objs, Data3=face_23.faces)
room_9 = HBRoom(faces=flatten(merge_8), name="Workshop 1", constr_set=constrsetclimate_9, program=list_9, conditioned=Toggle(True))  # -> report, room; plug-in component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

# ----
# PRAYER 1
bldgprograms_10 = HBBuildingPrograms({"LargeOffice", "MediumOffice", "SmallOffice", "MidriseApartment", "HighriseApartment", "Retail", "StripMall", "PrimarySchool", "SecondarySchool", "SmallHotel", "LargeHotel", "Hospital", "Outpatient", "Laboratory", "Warehouse", "SuperMarket", "FullServiceRestaurant", "QuickServiceRestaurant", "Courthouse", "LargeDataCenterHighITE", "LargeDataCenterLowITE", "SmallDataCenterHighITE", "SmallDataCenterLowITE"}, selected="SecondarySchool")
brep_10 = Brep([<brep referenced from the Rhino model> x7])
area_10 = Area(Geometry=brep_10)  # -> Area, Centroid
searchprog_10 = HBSearchPrograms(bldg_prog=bldgprograms_10)  # -> room_prog; plug-in component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
points_10 = PointList(Points=area_10.Centroid, Size=Slider(0.17, range=0..1))
list_10 = Honeybee_ItemSelector(
    searchprog_10,
    {"2013::SecondarySchool::Auditorium", "2013::SecondarySchool::Cafeteria", "2013::SecondarySchool::Classroom", "2013::SecondarySchool::ComputerRoom", "2013::SecondarySchool::Corridor", "2013::SecondarySchool::Gym", "2013::SecondarySchool::Kitchen", "2013::SecondarySchool::Library", "2013::SecondarySchool::Lobby", "2013::SecondarySchool::Mechanical", "2013::SecondarySchool::Office", "2013::SecondarySchool::Restroom"}, selected="2013::SecondarySchool::Lobby")
panel_27 = Panel(searchprog_10)
join_10 = BrepJoin(Breps=brep_10)  # -> Breps, Closed
geo_26 = Geometry(join_10.Breps)
face_26 = HBFace(geo=brep_10, bc="outdoors")  # -> report, faces; plug-in component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
bldgvintages_10 = HBBuildingVintages({"ASHRAE 90.1 2013  |  IECC 2015": "2013", "ASHRAE 90.1 2010  |  IECC 2012": "2010", "ASHRAE 90.1 2007  |  IECC 2009": "2007", "ASHRAE 90.1 2004  |  IECC 2006": "2004", "1980-2004 (CBECS)": "1980_2004", "Pre-1980 (CBECS)": "pre_1980"}, selected="ASHRAE 90.1 2013  |  IECC 2015")
climatezones_10 = HBClimateZones({"1 - Very Hot": "1", "2 - Hot": "2", "3 - Warm": "3", "4 - Mixed": "4", "5 - Cool": "5", "6 - Cold": "6", "7 - Very Cold": "7", "8 - Subarctic": "8"}, selected="3 - Warm")
constr_type_10 = Dragonfly_BldgAge({"SteelFramed", "WoodFramed", "Mass", "Metal Building"}, selected="Mass")
constrsetclimate_10 = HBConstructionSetByClimate(climate_zone=climatezones_10, vintage=bldgvintages_10, constr_type=constr_type_10)  # -> constr_set; plug-in component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
room_10 = HBRoom(faces=flatten(face_26.faces), name="PRAYER1", constr_set=constrsetclimate_10, program=list_10, conditioned=Toggle(True))  # -> report, room; plug-in component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

# ----
# PRAYER 2
bldgprograms_11 = HBBuildingPrograms({"LargeOffice", "MediumOffice", "SmallOffice", "MidriseApartment", "HighriseApartment", "Retail", "StripMall", "PrimarySchool", "SecondarySchool", "SmallHotel", "LargeHotel", "Hospital", "Outpatient", "Laboratory", "Warehouse", "SuperMarket", "FullServiceRestaurant", "QuickServiceRestaurant", "Courthouse", "LargeDataCenterHighITE", "LargeDataCenterLowITE", "SmallDataCenterHighITE", "SmallDataCenterLowITE"}, selected="SecondarySchool")
brep_11 = Brep([<brep referenced from the Rhino model> x7])
area_11 = Area(Geometry=brep_11)  # -> Area, Centroid
join_11 = BrepJoin(Breps=brep_11)  # -> Breps, Closed
searchprog_11 = HBSearchPrograms(bldg_prog=bldgprograms_11)  # -> room_prog; plug-in component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
points_11 = PointList(Points=area_11.Centroid, Size=Slider(0.17, range=0..1))
list_11 = Honeybee_ItemSelector(
    searchprog_11,
    {"2013::SecondarySchool::Auditorium", "2013::SecondarySchool::Cafeteria", "2013::SecondarySchool::Classroom", "2013::SecondarySchool::ComputerRoom", "2013::SecondarySchool::Corridor", "2013::SecondarySchool::Gym", "2013::SecondarySchool::Kitchen", "2013::SecondarySchool::Library", "2013::SecondarySchool::Lobby", "2013::SecondarySchool::Mechanical", "2013::SecondarySchool::Office", "2013::SecondarySchool::Restroom"}, selected="2013::SecondarySchool::Lobby")
panel_28 = Panel(searchprog_11)
geo_27 = Geometry(join_11.Breps)
face_27 = HBFace(geo=geo_27, bc="outdoors")  # -> report, faces; plug-in component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
bldgvintages_11 = HBBuildingVintages({"ASHRAE 90.1 2013  |  IECC 2015": "2013", "ASHRAE 90.1 2010  |  IECC 2012": "2010", "ASHRAE 90.1 2007  |  IECC 2009": "2007", "ASHRAE 90.1 2004  |  IECC 2006": "2004", "1980-2004 (CBECS)": "1980_2004", "Pre-1980 (CBECS)": "pre_1980"}, selected="ASHRAE 90.1 2013  |  IECC 2015")
climatezones_11 = HBClimateZones({"1 - Very Hot": "1", "2 - Hot": "2", "3 - Warm": "3", "4 - Mixed": "4", "5 - Cool": "5", "6 - Cold": "6", "7 - Very Cold": "7", "8 - Subarctic": "8"}, selected="3 - Warm")
constr_type_11 = Dragonfly_BldgAge({"SteelFramed", "WoodFramed", "Mass", "Metal Building"}, selected="Mass")
constrsetclimate_11 = HBConstructionSetByClimate(climate_zone=climatezones_11, vintage=bldgvintages_11, constr_type=constr_type_11)  # -> constr_set; plug-in component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
room_11 = HBRoom(faces=flatten(face_27.faces), name="PRAYER2", constr_set=constrsetclimate_11, program=list_11, conditioned=Toggle(True))  # -> report, room; plug-in component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

# ----
# GALLERY/AUDITORIUM
bldgprograms_12 = HBBuildingPrograms({"LargeOffice", "MediumOffice", "SmallOffice", "MidriseApartment", "HighriseApartment", "Retail", "StripMall", "PrimarySchool", "SecondarySchool", "SmallHotel", "LargeHotel", "Hospital", "Outpatient", "Laboratory", "Warehouse", "SuperMarket", "FullServiceRestaurant", "QuickServiceRestaurant", "Courthouse", "LargeDataCenterHighITE", "LargeDataCenterLowITE", "SmallDataCenterHighITE", "SmallDataCenterLowITE"}, selected="SecondarySchool")
brep_12 = Brep([<brep referenced from the Rhino model> x22])
panel_29 = Panel("""1
2
3
21
19
11
13
16
15""")
panel_30 = Panel("""4
5
8
9""")
area_12 = Area(Geometry=brep_12)  # -> Area, Centroid
join_12 = BrepJoin(Breps=brep_12)  # -> Breps, Closed
cull_i_9 = CullIndex(List=brep_12, Indices=[panel_29, panel_30], Wrap=True)
item_17 = ListItem(List=brep_12, Index=panel_29, Wrap=True)
item_18 = ListItem(List=brep_12, Index=panel_30, Wrap=True)
searchprog_12 = HBSearchPrograms(bldg_prog=bldgprograms_12)  # -> room_prog; plug-in component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
points_12 = PointList(Points=area_12.Centroid, Size=Slider(0.6, range=0..1))
list_12 = Honeybee_ItemSelector(
    searchprog_12,
    {"2013::SecondarySchool::Auditorium", "2013::SecondarySchool::Cafeteria", "2013::SecondarySchool::Classroom", "2013::SecondarySchool::ComputerRoom", "2013::SecondarySchool::Corridor", "2013::SecondarySchool::Gym", "2013::SecondarySchool::Kitchen", "2013::SecondarySchool::Library", "2013::SecondarySchool::Lobby", "2013::SecondarySchool::Mechanical", "2013::SecondarySchool::Office", "2013::SecondarySchool::Restroom"}, selected="2013::SecondarySchool::Auditorium")
panel_31 = Panel(searchprog_12)
window_ratio_9 = Slider(0.99, range=0.1..1.1)
geo_28 = Geometry(item_18)
geo_29 = Geometry(item_17)
geo_30 = Geometry(cull_i_9)
face_28 = HBFace(geo=geo_28, bc="outdoors")  # -> report, faces; plug-in component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
face_29 = HBFace(geo=geo_30, bc="outdoors")  # -> report, faces; plug-in component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
face_30 = HBFace(geo=geo_29, bc="outdoors")  # -> report, faces; plug-in component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
bldgvintages_12 = HBBuildingVintages({"ASHRAE 90.1 2013  |  IECC 2015": "2013", "ASHRAE 90.1 2010  |  IECC 2012": "2010", "ASHRAE 90.1 2007  |  IECC 2009": "2007", "ASHRAE 90.1 2004  |  IECC 2006": "2004", "1980-2004 (CBECS)": "1980_2004", "Pre-1980 (CBECS)": "pre_1980"}, selected="ASHRAE 90.1 2013  |  IECC 2015")
climatezones_12 = HBClimateZones({"1 - Very Hot": "1", "2 - Hot": "2", "3 - Warm": "3", "4 - Mixed": "4", "5 - Cool": "5", "6 - Cold": "6", "7 - Very Cold": "7", "8 - Subarctic": "8"}, selected="3 - Warm")
constr_type_12 = Dragonfly_BldgAge({"SteelFramed", "WoodFramed", "Mass", "Metal Building"}, selected="Mass")
aperturesbyratio_9 = HBAperturesByRatio(hb_objs=flatten(face_30.faces), ratio=window_ratio_9, subdivide=Toggle(False), operable=Toggle(True))  # -> report, hb_objs; plug-in component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
constrsetclimate_12 = HBConstructionSetByClimate(climate_zone=climatezones_12, vintage=bldgvintages_12, constr_type=constr_type_12)  # -> constr_set; plug-in component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
merge_9 = Merge(Data1=face_29.faces, Data2=aperturesbyratio_9.hb_objs, Data3=face_28.faces)
room_12 = HBRoom(faces=flatten(merge_9), name="Workshop 1", constr_set=constrsetclimate_12, program=list_12, conditioned=Toggle(True))  # -> report, room; plug-in component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

# ----
# INTERNET CAFE
bldgprograms_13 = HBBuildingPrograms({"LargeOffice", "MediumOffice", "SmallOffice", "MidriseApartment", "HighriseApartment", "Retail", "StripMall", "PrimarySchool", "SecondarySchool", "SmallHotel", "LargeHotel", "Hospital", "Outpatient", "Laboratory", "Warehouse", "SuperMarket", "FullServiceRestaurant", "QuickServiceRestaurant", "Courthouse", "LargeDataCenterHighITE", "LargeDataCenterLowITE", "SmallDataCenterHighITE", "SmallDataCenterLowITE"}, selected="QuickServiceRestaurant")
brep_13 = Brep([<brep referenced from the Rhino model> x15])
panel_32 = Panel("""2
3
7
8""")
panel_33 = Panel("""14
13
1
0
10""")
area_13 = Area(Geometry=brep_13)  # -> Area, Centroid
join_13 = BrepJoin(Breps=brep_13)  # -> Breps, Closed
cull_i_10 = CullIndex(List=brep_13, Indices=[panel_33, panel_32], Wrap=True)
item_19 = ListItem(List=brep_13, Index=panel_33, Wrap=True)
item_20 = ListItem(List=brep_13, Index=panel_32, Wrap=True)
searchprog_13 = HBSearchPrograms(bldg_prog=bldgprograms_13)  # -> room_prog; plug-in component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
points_13 = PointList(Points=area_13.Centroid, Size=Slider(0.61, range=0..1))
list_13 = Honeybee_ItemSelector(
    searchprog_13,
    {"2013::QuickServiceRestaurant::Attic", "2013::QuickServiceRestaurant::Dining", "2013::QuickServiceRestaurant::Kitchen"}, selected="2013::QuickServiceRestaurant::Dining")
panel_34 = Panel(searchprog_13)
window_ratio_10 = Slider(0.99, range=0.1..1.1)
geo_31 = Geometry(item_20)
geo_32 = Geometry(item_19)
geo_33 = Geometry(cull_i_10)
face_31 = HBFace(geo=geo_31, bc="outdoors")  # -> report, faces; plug-in component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
face_32 = HBFace(geo=geo_33, bc="outdoors")  # -> report, faces; plug-in component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
face_33 = HBFace(geo=geo_32, bc="outdoors")  # -> report, faces; plug-in component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
bldgvintages_13 = HBBuildingVintages({"ASHRAE 90.1 2013  |  IECC 2015": "2013", "ASHRAE 90.1 2010  |  IECC 2012": "2010", "ASHRAE 90.1 2007  |  IECC 2009": "2007", "ASHRAE 90.1 2004  |  IECC 2006": "2004", "1980-2004 (CBECS)": "1980_2004", "Pre-1980 (CBECS)": "pre_1980"}, selected="ASHRAE 90.1 2013  |  IECC 2015")
climatezones_13 = HBClimateZones({"1 - Very Hot": "1", "2 - Hot": "2", "3 - Warm": "3", "4 - Mixed": "4", "5 - Cool": "5", "6 - Cold": "6", "7 - Very Cold": "7", "8 - Subarctic": "8"}, selected="3 - Warm")
constr_type_13 = Dragonfly_BldgAge({"SteelFramed", "WoodFramed", "Mass", "Metal Building"}, selected="Mass")
aperturesbyratio_10 = HBAperturesByRatio(hb_objs=flatten(face_33.faces), ratio=window_ratio_10, subdivide=Toggle(False), operable=Toggle(True))  # -> report, hb_objs; plug-in component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
constrsetclimate_13 = HBConstructionSetByClimate(climate_zone=climatezones_13, vintage=bldgvintages_13, constr_type=constr_type_13)  # -> constr_set; plug-in component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
merge_10 = Merge(Data1=face_32.faces, Data2=aperturesbyratio_10.hb_objs, Data3=face_31.faces)
room_13 = HBRoom(faces=flatten(merge_10), name="Workshop 1", constr_set=constrsetclimate_13, program=list_13, conditioned=Toggle(True))  # -> report, room; plug-in component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

# ----
# STUDIO - Peformance
bldgprograms_14 = HBBuildingPrograms({"LargeOffice", "MediumOffice", "SmallOffice", "MidriseApartment", "HighriseApartment", "Retail", "StripMall", "PrimarySchool", "SecondarySchool", "SmallHotel", "LargeHotel", "Hospital", "Outpatient", "Laboratory", "Warehouse", "SuperMarket", "FullServiceRestaurant", "QuickServiceRestaurant", "Courthouse", "LargeDataCenterHighITE", "LargeDataCenterLowITE", "SmallDataCenterHighITE", "SmallDataCenterLowITE"}, selected="SecondarySchool")
brep_14 = Brep([<brep referenced from the Rhino model> x12])
panel_35 = Panel("""0
1
2
3
4""")
panel_36 = Panel("""5
6""")
area_14 = Area(Geometry=brep_14)  # -> Area, Centroid
join_14 = BrepJoin(Breps=brep_14)  # -> Breps, Closed
cull_i_11 = CullIndex(List=brep_14, Indices=[panel_35, panel_36], Wrap=True)
item_21 = ListItem(List=brep_14, Index=panel_35, Wrap=True)
item_22 = ListItem(List=brep_14, Index=panel_36, Wrap=True)
searchprog_14 = HBSearchPrograms(bldg_prog=bldgprograms_14)  # -> room_prog; plug-in component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
points_14 = PointList(Points=area_14.Centroid, Size=Slider(0.44, range=0..1))
list_14 = Honeybee_ItemSelector(
    searchprog_14,
    {"2013::SecondarySchool::Auditorium", "2013::SecondarySchool::Cafeteria", "2013::SecondarySchool::Classroom", "2013::SecondarySchool::ComputerRoom", "2013::SecondarySchool::Corridor", "2013::SecondarySchool::Gym", "2013::SecondarySchool::Kitchen", "2013::SecondarySchool::Library", "2013::SecondarySchool::Lobby", "2013::SecondarySchool::Mechanical", "2013::SecondarySchool::Office", "2013::SecondarySchool::Restroom"}, selected="2013::SecondarySchool::Auditorium")
panel_37 = Panel(searchprog_14)
window_ratio_11 = Slider(0.99, range=0.1..1.1)
geo_34 = Geometry(item_22)
geo_35 = Geometry(item_21)
geo_36 = Geometry(cull_i_11)
face_34 = HBFace(geo=geo_34, bc="outdoors")  # -> report, faces; plug-in component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
face_35 = HBFace(geo=geo_36, bc="outdoors")  # -> report, faces; plug-in component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
face_36 = HBFace(geo=geo_35, bc="outdoors")  # -> report, faces; plug-in component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
bldgvintages_14 = HBBuildingVintages({"ASHRAE 90.1 2013  |  IECC 2015": "2013", "ASHRAE 90.1 2010  |  IECC 2012": "2010", "ASHRAE 90.1 2007  |  IECC 2009": "2007", "ASHRAE 90.1 2004  |  IECC 2006": "2004", "1980-2004 (CBECS)": "1980_2004", "Pre-1980 (CBECS)": "pre_1980"}, selected="ASHRAE 90.1 2013  |  IECC 2015")
climatezones_14 = HBClimateZones({"1 - Very Hot": "1", "2 - Hot": "2", "3 - Warm": "3", "4 - Mixed": "4", "5 - Cool": "5", "6 - Cold": "6", "7 - Very Cold": "7", "8 - Subarctic": "8"}, selected="3 - Warm")
constr_type_14 = Dragonfly_BldgAge({"SteelFramed", "WoodFramed", "Mass", "Metal Building"}, selected="Mass")
aperturesbyratio_11 = HBAperturesByRatio(hb_objs=flatten(face_36.faces), ratio=window_ratio_11, subdivide=Toggle(False), operable=Toggle(True))  # -> report, hb_objs; plug-in component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
constrsetclimate_14 = HBConstructionSetByClimate(climate_zone=climatezones_14, vintage=bldgvintages_14, constr_type=constr_type_14)  # -> constr_set; plug-in component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
merge_11 = Merge(Data1=face_35.faces, Data2=aperturesbyratio_11.hb_objs, Data3=face_34.faces)
room_14 = HBRoom(faces=flatten(merge_11), name="Workshop 1", constr_set=constrsetclimate_14, program=list_14, conditioned=Toggle(True))  # -> report, room; plug-in component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

# ----
# Search Construction/Material Libraries
searchconstrs = HBSearchConstructions()  # -> opaque_constrs, window_constrs, shade_constrs; plug-in component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
searchmats = HBSearchMaterials(keywords="Plaster")  # -> opaque_mats, window_mats; plug-in component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
panel_38 = Panel(searchmats.opaque_mats)

# ----
# Search Construction/Material Libraries
searchconstrs_2 = HBSearchConstructions()  # -> opaque_constrs, window_constrs, shade_constrs; plug-in component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
searchmats_2 = HBSearchMaterials(keywords="Typical Insulation")  # -> opaque_mats, window_mats; plug-in component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
panel_39 = Panel(searchmats_2.opaque_mats)

number_slider = Slider(55, range=0..60)

# ---- group: Conversion to Meters
number_slider_2 = Slider(8, range=4..12)
# roughness
# thickness
# conductivity
# density
# specific heat
# thermal absorptance
# solar absorptance
# visible absorptance
panel_40 = Panel("39.37")
division = Division(A=number_slider_2, B=panel_40)
panel_41 = Panel(division)

number_slider_3 = Slider(1, range=0.5..5)
division_2 = Division(A=number_slider_3, B="39.37")
panel_42 = Panel(division_2)

division_3 = Division(A=Slider(1, range=0.5..5), B="39.37")
panel_43 = Panel(division_3)

# ----
panel_44 = Panel("""MediumSmooth
0.0095
0.579612121716
800.001829191
1089.29718546
0.9
0.7
0.7""")
item_23 = ListItem(List=searchmats_2.opaque_mats, Index=number_slider, Wrap=True)  # -> flatten(Item)
division_4 = Division(A=Slider(1, range=1..12), B="39.37")
item_24 = ListItem(List=searchmats.opaque_mats, Index=Slider(3, range=0..10), Wrap=True)
decnstrmat = HBDeconstructMaterial(mat=item_24)  # -> values, attr_names, r_val_si, r_val_ip; plug-in component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
decnstrmat_2 = HBDeconstructMaterial(mat=item_23)  # -> values, attr_names, r_val_si, r_val_ip; plug-in component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
# roughness
# thickness
# conductivity
# density
# specific heat
# thermal absorptance
# solar absorptance
# visible absorptance
panel_45 = Panel(division_4)
panel_46 = Panel("""MediumRough
0.2032
2.30845517442
2322.00530923
831.463539724
0.9
0.7
0.7""")
panel_47 = Panel(decnstrmat.values)
panel_48 = Panel(decnstrmat_2.values)
item_25 = ListItem(List=panel_44, Index=0, Wrap=True)  # -> Item, Item1, Item2, Item3, Item4, Item5, Item6, Item7
item_26 = ListItem(List=panel_46, Index=0, Wrap=True)  # -> Item, Item1, Item2, Item3, Item4, Item5, Item6, Item7
panel_49 = Panel(decnstrmat_2.attr_names)
panel_50 = Panel(decnstrmat.attr_names)
opaquemat = HBOpaqueMaterial(
    name="1IN CERAMIC PLASTER",
    thickness=panel_45,
    conductivity=item_25.Item2,
    density=item_25.Item3,
    spec_heat=item_25.Item4,
    roughness=item_25.Item,
    therm_absp=item_25.Item5,
    sol_absp=item_25.Item6,
    vis_absp=item_25.Item7)  # -> mat; plug-in component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
opaquemat_2 = HBOpaqueMaterial(
    name="Concrete Wall - Custom V3",
    thickness=panel_41,
    conductivity=item_26.Item2,
    density=item_26.Item3,
    spec_heat=item_26.Item4,
    roughness=item_26.Item,
    therm_absp=item_26.Item5,
    sol_absp=item_26.Item6,
    vis_absp=item_26.Item7)  # -> mat; plug-in component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
opaquemat_3 = HBOpaqueMaterial(
    name="Wall Air Gap - Custom V2",
    thickness=panel_42,
    conductivity="0.667",
    density="1.28",
    spec_heat="1000",
    roughness="Smooth",
    therm_absp="0.9",
    sol_absp=".7",
    vis_absp=".7")  # -> mat; plug-in component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
opaquemat_4 = HBOpaqueMaterial(name="1IN GFRC PANEL", thickness=panel_43, conductivity="0.7195", density="1856", spec_heat="839.4")  # -> mat; plug-in component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
panel_51 = Panel(opaquemat_2)
panel_52 = Panel(opaquemat)
panel_53 = Panel(opaquemat_4)
panel_54 = Panel(opaquemat_3)
panel_55 = Panel(item_23)

# ----
# Create Constructions
panel_56 = Panel("TUNIS TYP CONSTRUCTION")
merge_12 = Merge(Data1="Generic Low-e Glass", Data2="Generic Window Argon Gap", Data3="Generic Clear Glass")
merge_13 = Merge(Data1=opaquemat_4, Data2=opaquemat_3, Data3=panel_55, Data4=opaquemat_2, Data5=opaquemat)
windowconstr = HBWindowConstruction(name="High Insulation Glass", materials=merge_12)  # -> constr; plug-in component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
opaqueconstr = HBOpaqueConstruction(name=panel_56, materials=merge_13)  # -> constr; plug-in component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
panel_57 = Panel(windowconstr)
panel_58 = Panel(opaqueconstr)

merge_14 = Merge(
    Data1=room_8.room,
    Data2=room.room,
    Data3=room_2.room,
    Data4=room_3.room,
    Data5=room_6.room,
    Data6=room_7.room,
    Data7=room_4.room,
    Data8=room_5.room,
    Data9=room_14.room,
    Data10=room_12.room,
    Data11=room_13.room,
    Data12=room_9.room,
    Data13=room_10.room,
    Data14=room_11.room)

# ----
# ARCH 594 - 3 Variable Change (Air Gap, Insulation & Concrete Block Thickness)
subfacesubset = HBSubfaceSubset(window=windowconstr)  # -> subface_set; plug-in component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
exteriorsubset = HBExteriorConstructionSubset(exterior_wall=opaqueconstr)  # -> exterior_set; plug-in component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
constructionset = HBConstructionSet(name="Wall Mass Thickness Change", exterior_subset=exteriorsubset, subface_subset=subfacesubset)  # -> constr_set; plug-in component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
applyconstrset = HBApplyConstructionSet(rooms=merge_14, constr_set=constructionset)  # -> rooms; plug-in component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

model = HBModel(rooms=flatten(applyconstrset))  # -> report, model; plug-in component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
brep_15 = Brep([<brep referenced from the Rhino model> x9])
shade = HBShade(geo=brep_15, name="SuperRoof", attached=Toggle(True))  # -> report, shades; plug-in component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
preview = CustomPreview(Geometry=brep_15, Material=ColourSwatch(SwatchColor=RGBA(255, 255, 255, 61)))
toggle = BooleanToggle(False)
epw_file = FilePath("F:\OneDrive - University of Illinois - Urbana\00_SPRING2021\ARCH 594 - Spec Probs in Bldg Perf\Final Project\Weather File\TUN_Tunis.607150_IWEC.epw")
path = FilePath("C:\Users\Frank\Documents\ARCH594Tests\")

# ---- group: Run Me!
toggle_2 = BooleanToggle(False)

# ----
modeltoosm = HBModelToOSM(model=model.model, epw_file=epw_file, folder=path, write=toggle, run=toggle)  # -> report, jsons, osw, osm, idf, sql, zsz, rdd, html; plug-in component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
annualloads = HBAnnualLoads(rooms=applyconstrset, shades=shade.shades, epw_file=epw_file, run_bal=toggle_2, run=toggle_2)  # -> report, total_load, cooling, heating, lighting, equip, hot_water, balance; plug-in component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

# ----
# Visualize Room
vizbytype = HBVisualizeByType(hb_objs=applyconstrset)  # -> walls, interior_walls, roofs, ceilings, exterior_floors, interior_floors, air_walls, apertures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; plug-in component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

# ----
# Evaluate Total Load
ma = MassAddition(Input=annualloads.total_load)  # -> Result, PartialResults
panel_59 = Panel(annualloads.total_load)
total_load_intensity_kwh_m2 = Panel(ma.Result)
panel_60 = Panel("""cooling
heating
lighting
equipment""")

data = Data(flatten([annualloads.cooling, annualloads.heating, annualloads.lighting, annualloads.equip]))

# ----
# Visualize Monthly Load
swatch = ColourSwatch(SwatchColor=RGB(4, 25, 145))
monthly_loads = Data(data)
legendpar = LBLegendParameters(
    max="100",
    colors=[swatch, ColourSwatch(SwatchColor=RGB(153, 16, 0)), ColourSwatch(SwatchColor=RGB(255, 255, 0)), ColourSwatch(SwatchColor=RGB(255, 121, 0))],
    num_decimals="0",
    text_height="2")  # -> leg_par; plug-in component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
monthlychart = LBMonthlyChart(data=monthly_loads, base_pt="100,0,0", stack=Toggle(True), legend_par=legendpar)  # -> report, data_mesh, data_lines, legend, borders, labels, y_title, title; plug-in component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
item_27 = ListItem(List=monthlychart.legend, Index=0, Wrap=True)
medges = MeshEdges(Mesh=[monthlychart.data_mesh, item_27])  # -> NakedEdges, InteriorEdges, NonManifoldEdges

# ---- group: Cooling
item_28 = ListItem(List=annualloads.total_load, Index=0, Wrap=True)
panel_61 = Panel(item_28)

# ---- group: Heating
item_29 = ListItem(List=annualloads.total_load, Index=0, Wrap=True)  # -> Item, Item1
panel_62 = Panel(item_29.Item1)

# ---- group: Lighting
item_30 = ListItem(List=annualloads.total_load, Index=0, Wrap=True)  # -> Item, Item1
panel_63 = Panel(item_30.Item1)

# ----
# Visualize Load Balance
panel_64 = Panel("19")  # disabled
monthly_loads_2 = Data(annualloads.balance)  # disabled
panel_65 = Panel("30")  # disabled
colrange = LBColorRange(index=panel_64)  # -> colors; disabled; plug-in component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
neg = Negative(Value=panel_65)  # disabled
panel_66 = Panel("2")  # disabled
panel_67 = Panel("0")  # disabled
legendpar_2 = LBLegendParameters(min=neg, max=panel_65, colors=colrange, num_decimals=panel_67, text_height=panel_66)  # -> leg_par; disabled; plug-in component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
toggle_3 = BooleanToggle(True)  # disabled
panel_68 = Panel("100,-100,0")  # disabled
monthlychart_2 = LBMonthlyChart(data=monthly_loads_2, base_pt=panel_68, y_dim="80", stack=toggle_3, legend_par=legendpar_2)  # -> report, data_mesh, data_lines, legend, borders, labels, y_title, title; disabled; plug-in component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
item_31 = ListItem(List=monthlychart_2.legend, Index=0, Wrap=True)  # disabled
medges_2 = MeshEdges(Mesh=[monthlychart_2.data_mesh, item_31])  # -> NakedEdges, InteriorEdges, NonManifoldEdges; disabled

wallacei_x = WallaceiX(
    Genes=[number_slider_2, number_slider_3, number_slider],
    Objectives=[panel_61, panel_62],
    allFitness="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",
    allFrontIdx="0|6",
    allGenomes="6|1|28_10|3.5|26_7|4.7|6_9|0.6|15_7|5|41_9|1.8|37_10|3.7|57_5|1.2|23_10|1.3|48_6|4.2|53_8|3.7|42_4|5|48_11|0.8|31_8|1.7|60_10|2.2|26_9|3.5|28_6|2.1|32_5|2.1|42_7|1.2|57_5|4.9|29_9|0.7|7_6|0.9|19_8|1.9|60_11|4.1|13_5|1.3|26_12|2.3|46_12|1.1|30_7|0.8|28_7|2.2|22_4|3.3|50_11|4|5_4|4.5|14_11|2.6|18_5|1.1|22_8|2.2|33_6|0.8|10_6|2.5|45_5|1.1|51_12|1.9|59_9|4.3|42_12|2.9|41_5|0.6|1_5|0.8|18",
    curFrontIdx="0|6",
    curFrontIdxSave="0|6",
    popGen="50,100",
    total="468625",
    wlcDone=True)  # -> WallaceiGenomes, FitnessValues, Data, WPhenotypes
galapagos = Galapagos(fitness=item_28, gene=[number_slider_3, number_slider_2, number_slider])
