# Grasshopper definition _BeamGeneration_Sweep.gh (Grasshopper 1.0.7)
# plug-ins: Pufferfish

# ----
# BEAM STRUCTURE
# Projected Curves
# Beam Profile
curve = Curve(graft(<curve referenced from the Rhino model>))
geometry = Geometry(<curve referenced from the Rhino model>)

end_points = EndPoints(Curve=curve)  # -> Start, End
explode = Explode(Curve=geometry, Recursive=True)  # -> Segments, Vertices
list_item = ListItem(List=explode.Segments, Index=0, Wrap=True)  # -> Item, Item1, Item2, Item3, Item4
list_item_2 = ListItem(List=explode.Vertices, Index=0, Wrap=True)  # -> Item, Item1, Item2, Item3, Item4
deconstruct = Deconstruct(Point=end_points.End)  # -> XComponent, YComponent, ZComponent
deconstruct_2 = Deconstruct(Point=end_points.Start)  # -> XComponent, YComponent, ZComponent
point = Point(list_item_2.Item3)
curve_middle = CurveMiddle(Curve=list_item.Item2)
line = Line(StartPoint=curve_middle, EndPoint=point)
subtraction = Subtraction(A=deconstruct.ZComponent, B=deconstruct_2.ZComponent)
move_to_point = MoveToPoint(Geometry=geometry, PointA=curve_middle, PointB=end_points.Start)  # -> Moved, Vector, Transform
length = Length(Curve=line)
panel = Panel(subtraction)
explode_2 = Explode(Curve=move_to_point.Moved, Recursive=True)  # -> Segments, Vertices
unit_z = UnitZ(Factor=panel)
list_item_3 = ListItem(List=explode_2.Vertices, Index=0, Wrap=True)  # -> Item, Item1, Item2, Item3
list_item_4 = ListItem(List=explode_2.Segments, Index=0, Wrap=True)  # -> Item, Item1, Item2, Item3
negative = Negative(Value=unit_z)
move = Move(Geometry=end_points.End, Motion=negative)  # -> Geometry, Transform
curve_middle_2 = CurveMiddle(Curve=list_item_4.Item2)
line_2 = Line(StartPoint=list_item_3.Item3, EndPoint=curve_middle_2)
perp_frames = PerpFrames(Curve=line_2, Count="1", Align=True)  # -> Frames, Parameters
line_3 = Line(StartPoint=end_points.Start, EndPoint=move.Geometry)
perp_frames_2 = PerpFrames(Curve=line_3, Count="1", Align=True)  # -> Frames, Parameters
list_item_5 = ListItem(List=perp_frames.Frames, Index=0, Wrap=True)  # -> Item, Item1
plane = Plane(list_item_5.Item1)
list_item_6 = ListItem(List=perp_frames_2.Frames, Index=0, Wrap=True)  # -> Item, Item1
plane_2 = Plane(list_item_6.Item)
orient = Orient(Geometry=move_to_point.Moved, Source=plane, Target=plane_2)  # -> Geometry, Transform
explode_3 = Explode(Curve=orient.Geometry, Recursive=True)  # -> Segments, Vertices
list_item_7 = ListItem(List=explode_3.Segments, Index=0, Wrap=True)
curve_middle_3 = CurveMiddle(Curve=list_item_7)
line_4 = Line(StartPoint=end_points.Start, EndPoint=curve_middle_3)
rotate_axis = RotateAxis(Geometry=orient.Geometry, Angle=degrees(Slider(90, range=0..360)), Axis=line_4)  # -> Geometry, Transform
sweep1 = Sweep1(Rail=curve, Sections=rotate_axis.Geometry, Miter=1)
cap_holes = CapHoles(Brep=sweep1)
