# Grasshopper definition _LightFixtures.gh (Grasshopper 1.0.7)

brep = Brep(<brep referenced from the Rhino model>)
srf = Surface(<surface referenced from the Rhino model>)

# ---- group: Length of Light Fixture
number_slider = Slider(1, range=0..100)

# ---- group: Feet off of the Ground
number_slider_2 = Slider(21, range=0..100)

# ----
area = Area(Geometry=srf)  # -> Area, Centroid
number_slider_3 = Slider(6, range=0..20)
scale = Scale(Geometry=srf, Center=area.Centroid, Factor=Slider(0.8, range=0..1))  # -> Geometry, Transform
multiplication = Multiplication(A=Slider(50, range=0..100), B=Slider(12, range=0..100))
panel = Panel("""TRUE 
FALSE""")
sdivide = DivideSurface(Surface=scale.Geometry, UCount=number_slider_3, VCount=number_slider_3)  # -> Points, Normals, Parameters
multiplication_2 = Multiplication(A=number_slider_2, B=Slider(12, range=0..100))
cull = CullPattern(List=flatten(sdivide.Points), CullPattern=panel)  # -> graft(List)
Z = UnitZ(Factor=1)
Z_2 = UnitZ(Factor=multiplication_2)
line = LineSDL(Start=cull, Direction=Z, Length=multiplication)

# ---- group: Radius of Fixture
number_slider_4 = Slider(1.5, range=0..10)

# ----
move = Move(Geometry=cull, Motion=Z_2)  # -> Geometry, Transform
bcx = BrepCurve(Brep=brep, Curve=line)  # -> Curves, graft(Points)
multiplication_3 = Multiplication(A=number_slider, B=Slider(12, range=0..100))
cir = Circle(Plane=move.Geometry, Radius=number_slider_4)
brep_2 = Brep(cir)
Z_3 = UnitZ(Factor=multiplication_3)
ln = Line(StartPoint=move.Geometry, EndPoint=bcx.Points)
move_2 = Move(Geometry=move.Geometry, Motion=Z_3)  # -> Geometry, Transform
cir_2 = Circle(Plane=bcx.Points, Radius=Slider(1.5, range=0..10))
cir_3 = Circle(Plane=move_2.Geometry, Radius=Slider(1.5, range=0..10))
Z_4 = UnitZ(Factor=Slider(1.25, range=0..2))
Z_5 = UnitZ(Factor=Slider(1.25, range=0..2))
brep_3 = Brep(cir_2)
brep_4 = Brep(cir_3)
neg = Negative(Value=Z_4)

extr = Extrude(Base=brep_4, Direction=Z_5)
extr_2 = Extrude(Base=brep_3, Direction=neg)
extr_3 = Extrude(Base=brep_2, Direction=Z_3)
pipe = Pipe(Curve=ln, Radius=Slider(0.25, range=0..1), Caps=Slider(1, range=0..1))

merge = Merge(Data1=extr, Data2=extr_2)
