# Grasshopper definition _PercentageOfAreaCircleCreation_WaffleVoids.gh (Grasshopper 1.0.7)
# plug-ins: Pufferfish, LunchBox

geometry = Geometry([<brep referenced from the Rhino model> x35])
area = Area(Geometry=geometry)  # -> Area, Centroid
scale = Scale(Geometry=geometry, Center=area.Centroid, Factor=Slider(0.65, range=0..1))  # -> Geometry, Transform
pi = Pi(Factor=1)
multiplication = Multiplication(A=area.Area, B=Slider(0.52, range=0..1))
division = Division(A=multiplication, B=pi)
square_root = SquareRoot(Value=division)
panel = Panel(square_root)
circle_cnr = CircleCNR(Center=area.Centroid, Normal=Vector(0, 0, 1), Radius=square_root)
brep = Brep(circle_cnr)
unit_z = UnitZ(Factor=Slider(10, range=0..10))
area_2 = Area(Geometry=brep)  # -> Area, Centroid
extrude = Extrude(Base=brep, Direction=unit_z)
curve = Curve([<curve referenced from the Rhino model> x2410])
area_3 = Area(Geometry=extrude)  # -> Area, Centroid
brep_2 = Brep(curve)
area_4 = Area(Geometry=brep_2)  # -> Area, Centroid
move_to_point = MoveToPoint(Geometry=extrude, PointA=area_3.Centroid, PointB=area_2.Centroid)  # -> Moved, Vector, Transform
brep_3 = Brep(graft(move_to_point.Moved))
point_in_brep = PointInBrep(Brep=brep_3, Point=area_4.Centroid, Strict=False)
cull_pattern = CullPattern(List=brep_2, CullPattern=point_in_brep)
curve_2 = Curve(cull_pattern)
brep_4 = Brep(curve_2)

# ---- group: OPTION 2 (RECCOMENDED)
percentage = Slider(0.68, range=0..1)
random_split_list = RandomSplitList(MasterList=brep_4, Seed=Slider(7, range=0..10), Split=percentage)  # -> ListA, ListB
geometry_2 = Geometry(random_split_list.ListB)
geometry_3 = Geometry(random_split_list.ListA)
custom_preview = CustomPreview(Geometry=geometry_3, Material=ColourSwatch(SwatchColor=RGB(255, 255, 255)))

# ---- group: OPTION 1 (BASIC)
jitter = Jitter(List=brep_4, Jitter=Slider(1, range=0..1), Seed=2)  # -> Values, Indices
list_length = ListLength(List=jitter.Values)
multiplication_2 = Multiplication(A=list_length, B=Slider(0.2, range=0..1))
split_list = SplitList(List=jitter.Values, Index=multiplication_2)  # -> ListA, ListB
geometry_4 = Geometry(split_list.ListA)
geometry_5 = Geometry(split_list.ListB)
custom_preview_2 = CustomPreview(Geometry=geometry_4, Material=ColourSwatch(SwatchColor=RGB(255, 255, 255)))
