# Grasshopper definition _RandomizeSelection.gh (Grasshopper 1.0.7)
# plug-ins: LunchBox

curve = Curve([<curve referenced from the Rhino model> x2410])
brep = Brep(flatten(curve))

# ---- group: OPTION 2 (RECCOMENDED)
random_split_list = RandomSplitList(MasterList=brep, Seed=Slider(1, range=0..10), Split=Slider(0.8, range=0..1))  # -> ListA, ListB
geometry = Geometry(random_split_list.ListB)
geometry_2 = Geometry(random_split_list.ListA)
custom_preview = CustomPreview(Geometry=geometry_2, Material=ColourSwatch(SwatchColor=RGB(255, 255, 255)))

# ---- group: OPTION 1 (BASIC)
jitter = Jitter(List=brep, Jitter=Slider(1, range=0..1), Seed=2)  # -> Values, Indices
list_length = ListLength(List=jitter.Values)
multiplication = Multiplication(A=list_length, B=Slider(0.2, range=0..1))
split_list = SplitList(List=jitter.Values, Index=multiplication)  # -> ListA, ListB
geometry_3 = Geometry(split_list.ListA)
geometry_4 = Geometry(split_list.ListB)
custom_preview_2 = CustomPreview(Geometry=geometry_3, Material=ColourSwatch(SwatchColor=RGB(255, 255, 255)))
