# Grasshopper definition _ScallopingTexture.gh (Grasshopper 1.0.7)
# plug-ins: Pufferfish, Heteroptera, LunchBox

crv = Curve(<curve referenced from the Rhino model>)
flip = FlipCurve(Curve=crv)  # -> Curve, Flag
genes = GenePool(Decimals=0, Maximum=10, Minimum=3, Value=[4.75, 6.5, 8.25, 10])

# ---- group: Flip direction of movement
toggle = BooleanToggle(True)

# ----
crv_2 = Curve(crv)
item = ListItem(List=genes, Index=0, Wrap=True)  # -> Item, Item1, Item2, Item3
panel = Panel("""-1
0""")
divlength = DivideLength(Curve=crv_2, Length=Slider(32, range=0..100))  # -> Points, Tangents, Parameters
divide = DivideCurve(Curve=crv_2, Count=Slider(300, range=0..500), Kinks=False)  # -> Points, Tangents, Parameters
multiplication = Multiplication(A=Slider(12.5, range=0..100), B=Slider(12, range=0..100))
cull_i = CullIndex(List=divide.Points, Indices=panel, Wrap=True)
Z = UnitZ(Factor=multiplication)
panel_2 = Panel("""-1
0""")
randomsplit = RandomSplitList(MasterList=cull_i, Seed=Slider(55, range=0..100), Split=Slider(0.22, range=0..1))  # -> ListA, ListB
extr = Extrude(Base=crv_2, Direction=Z)
division = Division(A=item.Item, B="2")
geo = Geometry(randomsplit.ListB)
cull_i_2 = CullIndex(List=divlength.Points, Indices=panel_2, Wrap=True)
geo_2 = Geometry(randomsplit.ListA)
number_slider = Slider(0.25, range=0..1)
cir = Circle(Plane=geo, Radius=division)  # -> graft(Circle)

Z_2 = UnitZ(Factor=1)
ccx = CurveCurve(CurveA=crv_2, CurveB=cir)  # -> Points, ParamsA, ParamsB
line = LineSDL(Start=cir, Direction=Z_2, Length=1)
rotax = RotateAxis(Geometry=ccx.Points, Angle=degrees(Slider(90, range=0..90)), Axis=line)  # -> Geometry, Transform
item_2 = ListItem(List=rotax.Geometry, Index=0, Wrap=True)  # -> Item, Item1
filter = StreamFilter(Gate=toggle, Stream0=item_2.Item, Stream1=item_2.Item1)
ln = Line(StartPoint=cir, EndPoint=filter)
curvepoint = PointOnCurve(ln, parameter=0.25)
move2pt = MoveToPoint(Geometry=cir, PointA=filter, PointB=curvepoint)  # -> Moved, Vector, Transform

line_2 = LineSDL(Start=cull_i_2, Direction=Vector(0, 0, 1), Length=multiplication)
neg = Negative(Value=number_slider)
randomsplit_2 = RandomSplitList(MasterList=geo_2, Seed=Slider(55, range=0..100), Split=Slider(0.22, range=0..1))  # -> ListA, ListB
number_slider_2 = Slider(8, range=0..10)
offsets = OffsetOnSrf(Curve=line_2, Distance=neg, Surface=extr)
offsets_2 = OffsetOnSrf(Curve=line_2, Distance=number_slider, Surface=extr)
geo_3 = Geometry(randomsplit_2.ListA)
ext = ExtendCurve(Curve=offsets_2, Type=0, Start=number_slider_2, End=number_slider_2)
ext_2 = ExtendCurve(Curve=offsets, Type=0, Start=number_slider_2, End=number_slider_2)
loft = Loft(Curves=[ext, ext_2], Options={Adjust=False, Closed=False, LoftEnds=0, LoftSimp=0, LoftType=0, Rebuild=10, Refit=0.01})
neg_2 = Negative(Value=Slider(2.5, range=0..3))
randomsplit_3 = RandomSplitList(MasterList=geo_2, Seed=Slider(55, range=0..100), Split=Slider(0.5, range=0..1))  # -> ListA, ListB
offsrf = OffsetSurface(Surface=extr, Distance=neg_2, BothSides=Toggle(True), CreateSolid=True)
division_2 = Division(A=item.Item1, B="2")
geo_4 = Geometry(randomsplit_2.ListB)
offsrf_2 = OffsetSurface(Surface=loft, Distance=Slider(3, range=0..3), BothSides=Toggle(True), CreateSolid=True)  # -> flatten(Offset)
cir_2 = Circle(Plane=geo_4, Radius=division_2)  # -> graft(Circle)

Z_3 = UnitZ(Factor=1)
ccx_2 = CurveCurve(CurveA=crv_2, CurveB=cir_2)  # -> Points, ParamsA, ParamsB
line_3 = LineSDL(Start=cir_2, Direction=Z_3, Length=1)
rotax_2 = RotateAxis(Geometry=ccx_2.Points, Angle=degrees(Slider(90, range=0..90)), Axis=line_3)  # -> Geometry, Transform
item_3 = ListItem(List=rotax_2.Geometry, Index=0, Wrap=True)  # -> Item, Item1
filter_2 = StreamFilter(Gate=toggle, Stream0=item_3.Item, Stream1=item_3.Item1)
ln_2 = Line(StartPoint=cir_2, EndPoint=filter_2)
curvepoint_2 = PointOnCurve(ln_2, parameter=0.25)
move2pt_2 = MoveToPoint(Geometry=cir_2, PointA=filter_2, PointB=curvepoint_2)  # -> Moved, Vector, Transform

splitmul = SplitBrepMultiple(Brep=offsrf, Cutters=offsrf_2)  # disabled
area = Area(Geometry=splitmul)  # -> Area, Centroid; disabled
panel_3 = Panel(area.Area)  # disabled
extremums = MinMax(Number=area.Area)  # -> Minimum, Maximum; disabled
panel_4 = Panel(area.Area)  # disabled
panel_5 = Panel(extremums.Minimum)  # disabled
division_3 = Division(A=item.Item2, B="2")
geo_5 = Geometry(randomsplit_3.ListB)
larger = LargerThan(FirstNumber=panel_3, SecondNumber=panel_5)  # -> LargerThan, OrEqualTo; disabled
cir_3 = Circle(Plane=geo_5, Radius=division_3)  # -> graft(Circle)
cull = CullPattern(List=splitmul, CullPattern=larger.LargerThan)  # disabled
Z_4 = UnitZ(Factor=1)
ccx_3 = CurveCurve(CurveA=crv_2, CurveB=cir_3)  # -> Points, ParamsA, ParamsB
line_4 = LineSDL(Start=cir_3, Direction=Z_4, Length=1)
rotax_3 = RotateAxis(Geometry=ccx_3.Points, Angle=degrees(Slider(90, range=0..90)), Axis=line_4)  # -> Geometry, Transform
Z_5 = UnitZ(Factor=Slider(5, range=0..5))
item_4 = ListItem(List=rotax_3.Geometry, Index=0, Wrap=True)  # -> Item, Item1
extr_2 = Extrude(Direction=Z_5)
filter_3 = StreamFilter(Gate=toggle, Stream0=item_4.Item, Stream1=item_4.Item1)
neg_3 = Negative(Value=Slider(2, range=0..2))
division_4 = Division(A=item.Item3, B="2")
geo_6 = Geometry(randomsplit_3.ListA)
ln_3 = Line(StartPoint=cir_3, EndPoint=filter_3)
offsrf_3 = OffsetSurface(Surface=extr_2, Distance=neg_3, BothSides=False, CreateSolid=True)
curvepoint_3 = PointOnCurve(ln_3, parameter=0.25)
cir_4 = Circle(Plane=geo_6, Radius=division_4)  # -> graft(Circle)
move2pt_3 = MoveToPoint(Geometry=cir_3, PointA=filter_3, PointB=curvepoint_3)  # -> Moved, Vector, Transform
debrep = DeconstructBrep(Brep=offsrf_3)  # -> Faces, Edges, Vertices
item_5 = ListItem(List=debrep.Edges, Index=Slider(3, range=0..5), Wrap=True)
item_6 = ListItem(List=debrep.Edges, Index=Slider(7, range=0..10), Wrap=True)
number_slider_3 = Slider(3, range=0..10)
Z_6 = UnitZ(Factor=1)
ccx_4 = CurveCurve(CurveA=crv_2, CurveB=cir_4)  # -> Points, ParamsA, ParamsB
divide_2 = DivideCurve(Curve=item_6, Count=number_slider_3, Kinks=False)  # -> reverse(Points), Tangents, Parameters
divide_3 = DivideCurve(Curve=item_5, Count=number_slider_3, Kinks=False)  # -> Points, Tangents, Parameters
panel_6 = Panel("""-1
0""")
line_5 = LineSDL(Start=cir_4, Direction=Z_6, Length=1)
rotax_4 = RotateAxis(Geometry=ccx_4.Points, Angle=degrees(Slider(90, range=0..90)), Axis=line_5)  # -> Geometry, Transform
cull_i_3 = CullIndex(List=divide_3.Points, Indices=panel_6, Wrap=True)  # -> flatten(List)
cull_i_4 = CullIndex(List=divide_2.Points, Indices=panel_6, Wrap=True)  # -> flatten(List)
item_7 = ListItem(List=rotax_4.Geometry, Index=0, Wrap=True)  # -> Item, Item1
ln_4 = Line(StartPoint=cull_i_3, EndPoint=cull_i_4)
filter_4 = StreamFilter(Gate=toggle, Stream0=item_7.Item, Stream1=item_7.Item1)
ln_5 = Line(StartPoint=cir_4, EndPoint=filter_4)
randomsplit_4 = RandomSplitList(MasterList=cull_i_3, Seed=Slider(3, range=0..10), Split=Slider(0.45, range=0..1))  # -> ListA, ListB
curvepoint_4 = PointOnCurve(ln_5, parameter=0.25)
cir_5 = Circle(Plane=randomsplit_4.ListA, Radius=Slider(3, range=0..10))
move2pt_4 = MoveToPoint(Geometry=cir_4, PointA=filter_4, PointB=curvepoint_4)  # -> Moved, Vector, Transform
merge = Merge(Data1=move2pt.Moved, Data2=move2pt_2.Moved, Data3=move2pt_4.Moved, Data4=move2pt_3.Moved)
brep = Brep(<brep referenced from the Rhino model>)
area_2 = Area(Geometry=brep)  # -> Area, Centroid
Z_7 = UnitZ(Factor=multiplication)
brep_2 = Brep(merge)
extr_3 = Extrude(Base=brep_2, Direction=Z_7)
sunion = SolidUnion(Breps=extr_3)
scale = Scale(Geometry=brep, Center=area_2.Centroid, Factor=Slider(2, range=0..2))  # -> Geometry, Transform
