# Grasshopper definition _SolarPanelGeneration.gh (Grasshopper 1.0.7)
# plug-ins: Heteroptera

# ---- group: Increase or Decrease to change the dimensions of the rectangles
number_slider = Slider(150, range=0..500)
number_slider_2 = Slider(150, range=0..500)

# ---- group: Change the distance between the squares
panel = Panel(".5")

# ---- group: Inpu the rectangle that is parallel to the roof's smallest edge.
brep = Brep(<brep referenced from the Rhino model>)

# ---- group: Roof line (As projected on the ground)
curve = Curve(<curve referenced from the Rhino model>)

# ----
deconstruct_brep = DeconstructBrep(Brep=brep)  # -> Faces, Edges, Vertices
geometry = Geometry(deconstruct_brep.Edges)
join_curves = JoinCurves(Curves=geometry, Preserve=False)
negative = Negative(Value=panel)
offset_curve = OffsetCurve(Curve=join_curves, Distance=negative, Plane=PlaneXY(0, 0, 0), Corners=1)
brep_2 = Brep(offset_curve)
brep_3 = Brep(curve)
divide_domain² = DivideDomain²(Domain=brep_2, UCount=number_slider, VCount=number_slider_2)
deconstruct_brep_2 = DeconstructBrep(Brep=brep_3)  # -> Faces, Edges, Vertices
isotrim = Isotrim(Surface=brep_2, Domain=divide_domain²)
geometry_2 = Geometry(deconstruct_brep_2.Edges)
join_curves_2 = JoinCurves(Curves=geometry_2, Preserve=False)
offset_curve_loose = OffsetCurveLoose(Curve=isotrim, Distance=Slider(-0.1, range=-5..5))
offset_curve_2 = OffsetCurve(Curve=join_curves_2, Distance=panel, Plane=PlaneXY(0, 0, 0), Corners=1)

# ---- group: If you want the edges to be slighty rounded, then use this.
fillet = Fillet(Curve=offset_curve_loose, Radius=Slider(0.5, range=0..1))

# ----
brep_4 = Brep(offset_curve_2)
brep_curve = BrepCurve(Brep=brep_2, Curve=offset_curve_loose)  # -> Curves, Points
brep_5 = Brep(flatten(brep_curve.Curves))
brep_brep = BrepBrep(BrepA=brep_4, BrepB=brep_5)  # -> Curves, Points
brep_6 = Brep(flatten(brep_brep.Curves))
area = Area(Geometry=brep_6)  # -> Area, Centroid
min_max = MinMax(Number=area.Area)  # -> Minimum, Maximum
integer = Integer(min_max.Maximum)
smaller_than = SmallerThan(FirstNumber=area.Area, SecondNumber=integer)  # -> SmallerThan, OrEqualTo
larger_than = LargerThan(FirstNumber=area.Area, SecondNumber=integer)  # -> LargerThan, OrEqualTo
panel_2 = Panel(min_max.Maximum)
cull_pattern = CullPattern(List=brep_6, CullPattern=smaller_than.OrEqualTo)
cull_pattern_2 = CullPattern(List=brep_6, CullPattern=larger_than.OrEqualTo)
brep_7 = Brep(cull_pattern_2)
brep_8 = Brep(cull_pattern)

# ---- group: Gradient Test
number_slider_3 = Slider(0.1, range=0..0.1)  # disabled
negative_2 = Negative(Value=number_slider_3)  # disabled
offset_curve_3 = OffsetCurve(Curve=brep_7, Distance=negative_2, Plane=PlaneXY(0, 0, 0), Corners=1)  # disabled
divide_surface = DivideSurface(Surface=offset_curve_3, UCount=10, VCount=10)  # -> Points, Normals, Parameters; disabled
number_slider_4 = Slider(0.01, range=0..0.01)  # disabled
rectangle = Rectangle(Plane=divide_surface.Points, XSize=number_slider_4, YSize=number_slider_4, Radius=0)  # -> Rectangle, Length; disabled
colour_swatch = ColourSwatch(SwatchColor=RGB(235, 235, 235))  # disabled
custom_preview = CustomPreview(Geometry=rectangle.Rectangle, Material=colour_swatch)  # disabled

# ----
custom_preview_2 = CustomPreview(Geometry=brep_7, Material=ColourSwatch(SwatchColor=RGB(0, 30, 56)))
custom_preview_3 = CustomPreview(Geometry=brep_8, Material=ColourSwatch(SwatchColor=RGB(0, 16, 31)))
