# Grasshopper definition _StressLinesMerging_SingleSurface.gh (Grasshopper 1.0.7)
# plug-ins: Pufferfish

curve = Curve(<curve referenced from the Rhino model>)
curve_2 = Curve([<curve referenced from the Rhino model> x79])
boolean_toggle = BooleanToggle(True)

# ---- group: Outside Curves
curve_3 = Curve([<curve referenced from the Rhino model> x22])

# ----
division = Division(A=Slider(6, range=0..24), B=Slider(12, range=0..100))
join_curves = JoinCurves(Curves=curve_3, Preserve=False)
number_slider = Slider(1, range=0..1)
negative = Negative(Value=division)
offset_curve = OffsetCurve(Curve=curve, Distance=division, Plane=PlaneXY(0, 0, 0), BothSides=boolean_toggle, Kinks=0, CapType=1)
loft = Loft(Curves=offset_curve, Options={Adjust=False, Closed=False, LoftEnds=0, LoftSimp=0, LoftType=0, Rebuild=10, Refit=0.01})
extend_curve = ExtendCurve(Curve=curve_2, Type=0, Start=number_slider, End=number_slider)
offset_curve_2 = OffsetCurve(
    Curve=extend_curve,
    Distance=division,
    Plane=PlaneXY(0, 0, 0),
    BothSides=boolean_toggle,
    Kinks=0,
    CapType=Slider(0, range=0..3))
loft_2 = Loft(Curves=offset_curve_2, Options={Adjust=False, Closed=False, LoftEnds=0, LoftSimp=0, LoftType=0, Rebuild=10, Refit=0.01})
offset_curve_3 = OffsetCurve(Curve=join_curves, Distance=negative, Plane=PlaneXY(0, 0, 0), Corners=1)
curve_4 = Curve([<curve referenced from the Rhino model> x37])
brep_edges = BrepEdges(Brep=loft)  # -> Naked, Interior, NonManifold
brep_edges_2 = BrepEdges(Brep=loft_2)  # -> Naked, Interior, NonManifold
brep = Brep(offset_curve_3)
merge = Merge(Data1=brep_edges.Naked)
join_curves_2 = JoinCurves(Curves=[brep_edges_2.Naked, merge], Preserve=False)
offset_curve_4 = OffsetCurve(Curve=curve_4, Distance=division, Plane=PlaneXY(0, 0, 0), Corners=1)
region_union = RegionUnion(Curves=flatten(join_curves_2))
boundary_surfaces = BoundarySurfaces(Edges=region_union)
brep_brep = BrepBrep(BrepA=brep, BrepB=boundary_surfaces)  # -> Curves, Points
join_curves_3 = JoinCurves(Curves=flatten(brep_brep.Curves), Preserve=False)
boundary_surfaces_2 = BoundarySurfaces(Edges=join_curves_3)
